vi "A3.gvi"   [LabVIEW NXG]
inputs:
  "y": waveform<f64> = {dt=0.1, Y=[]}
outputs:
  "modulé": waveform<f64>
diagram:
  w1 = 20000000  # fc
  w2 = 0.7  # ka
  call "MT Modulate AM (DSB).gvi"(message signal=$y, modulation index=w2, suppress carrier?=FALSE) -> (am modulated waveform=w3)
  call "MT Upconvert Baseband (Real).gvi"(baseband waveform=w3, carrier frequency=w1) -> (passband waveform=w4)
  $modulé <- w4
