vi "Détecteur de crête.gvi"   [LabVIEW NXG]
inputs:
  "modulé": waveform<f64> = {dt=0.1, Y=[]}
  "fs": f64
outputs:
  "Abs": waveform<f64>
  "Filtered": waveform<f64>
diagram:
  Property Node(instance in=$modulé) -> ("Y"=w1, "dt"=w2)
  Absolute Value(x=w1) -> w3
  Build Waveform Node(Y=w3, dt=w2) -> (output waveform=w4)
  $Abs <- w4
  call "FIR Windowed Coefficients.gvi"(filter type="Lowpass", sampling frequency=$fs, low cutoff frequency=20000000) -> (FIR windowed coefficients=w5)
  call "FIR Filter (DBL).gvi"(x=w3, FIR coefficients=w5) -> (filtered x=w6)
  Build Waveform Node(Y=w6, dt=w2) -> (output waveform=w7)
  $Filtered <- w7
