vi "FFT.gvi"   [LabVIEW NXG]
inputs:
  "T": f64
  "y": waveform<f64> = {dt=0.1, Y=[]}
outputs:
  "FFT": cluster{"y": f64, "f0": f64, "d0": f64[]}
diagram:
  w1 = cluster{"f0": f64, "df": f64, "y": f64[]} {all zero or empty}
  Reciprocal(x=$T) -> w2
  Property Node(instance in=$y) -> ("Y"=w3, "dt"=w4)
  Reciprocal(x=w4) -> w5
  Divide(x=w5, y=-2) -> w6
  call "Real FFT.gvi"(x=w3, shift?=TRUE) -> (FFT {x}=w7)
  Absolute Value(x=w7) -> w8
  Property Node(instance in=w1, "y"=w8, "f0"=w6, "df"=w2) -> (instance out=w9)
  $FFT <- w9
