vi "Function.gvi"   [LabVIEW NXG]
panel indicators:
  "Graph": f64[]
  "Modulant": waveform<f64>
  "abs(FFT)": cluster{"y": f64, "f0": f64, "d0": f64[]}
  "démodulé (downconverted)": cluster{"t0": f64, "dt": f64, "Y": c128[]}
  "démodulé": waveform<f64>
  "Abs": waveform<f64>
  "Filtered": waveform<f64>
  "X_modulant_Y_modulé": cluster{"Element 1": f64[], "Element 2": f64[]}
  "X_modumant_Y_démodulé_C": cluster{"Element 1": f64[], "Element 2": f64[]}
  "X_modulant_Y_démodulé": cluster{"Element 1": f64[], "Element 2": f64[]}
diagram:
  w1 = 200000000  # fs
  w2 = 2e-05  # T
  Multiply(w2, w1) -> w3
  Round To Nearest(number=w3) -> w4
  To Long Integer(number=w4) -> w5
  for (N = w5) (iteration -> i1) {
    Reciprocal(x=w1) -> w7
    To Double Precision Float(number=i1) -> w8
    Multiply(w7, w8) -> w9
    append w9 to w6
  }
  $Graph <- w6
  Reciprocal(x=w1) -> w10
  Multiply(w6, PiTimes2, 400000) -> w11
  Cosine(x=w11) -> w12
  Multiply(1, w12) -> w13
  Build Waveform Node(Y=w13, dt=w10) -> (output waveform=w14)
  $Modulant <- w14
  call "A3.gvi"(y=w14, ka=0.7) -> (modulé=w15)
  call "XY.gvi"(X=w14, Y=w15) -> (created cluster=w16)
  $X_modulant_Y_modulé <- w16
  call "FFT.gvi"(T=w2, y=w14) -> (FFT=w17)
  $"abs(FFT)" <- w17
  call "Démodulateur_Cohérent.gvi"(y=w15, ka=0.7) -> (démodulé=w18, démodulé (downconverted)=w19)
  $démodulé <- w18
  call "XY.gvi"(X=w14, Y=w18) -> (created cluster=w20)
  $X_modumant_Y_démodulé_C <- w20
  $"démodulé (downconverted)" <- w19
  call "Détecteur de crête.gvi"(modulé=w15, fs=w1) -> (Abs=w21, Filtered=w22)
  $Abs <- w21
  call "XY.gvi"(X=w14, Y=w22) -> (created cluster=w23)
  $X_modulant_Y_démodulé <- w23
  $Filtered <- w22
