vi "XY.gvi"   [LabVIEW NXG]
panel controls:
  "X": waveform<f64> = {dt=0.1, Y=[]}
  "Y": waveform<f64> = {dt=0.1, Y=[]}
panel indicators:
  "Cluster": cluster{"2D Numeric Output": f64[][]}
diagram:
  Property Node(instance in=$X) -> ("Y"=w1)
  Property Node(instance in=$Y) -> ("Y"=w2)
  Build Cluster(w1, w2) -> w3
  $Cluster <- w3
