vi "add_control.gvi"   [LabVIEW NXG]
inputs:
  "error in (no error)": error
  "input": c128[] = [1+0i, -1+0i, -1+0i, 1+0i, -1+0i, 1+0i, -1+0i, -1+0i, -1+0i, -1+0i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]
  "Modulation Parameters In": T5 = {"Modulation Type"="QPSK", "Pulse Shaping Parameters"={"Modulation Type"="PSK", "Pulse Shaping Filter"="Raised Cosine", "Filter Parameter"=0.5, "Filter Length (Symbols)"=8}, "TX Oversample Factor"=20, "Packet Length (Bits)"=500, "TX Sample Rate"=100, "Control Information For Packet Header/Tail"={"Training Sequence "="Length 11 Barker Sequence", "Zero Pad Length"=8}}
outputs:
  "error out": error
  "output": c128[]
  "Modulation Parameters Out": T5
  "training symbols": c128[]
panel controls:
  "Training Sequences": T1 = {"Neumann Hoffman Binary Code"=[1, 1, 1, 1, 1, 1, 0, 0, 1, 1, 0, 1, 0], "Length 11 Barker Sequence"=[0, 0, 0, 1, 1, 1, 0, 1, 1, 0, 1]}
types:
  T1 = cluster{"Neumann Hoffman Binary Code": i8[], "Length 11 Barker Sequence": i8[]}
  T2 = enum{"none", "Raised Cosine", "Root Raised Cos", "Gaussian"}
  T3 = cluster{"Modulation Type": enum{"FSK", "PSK", "QAM", "MSK", "PAM", "ASK"}, "Pulse Shaping Filter": T2, "Filter Parameter": f64, "Filter Length (Symbols)": i32}
  T4 = cluster{"Training Sequence ": string, "Zero Pad Length": i32}
  T5 = cluster{"Modulation Type": string, "Pulse Shaping Parameters": T3, "TX Oversample Factor": i32, "Packet Length (Bits)": i32, "TX Sample Rate": f64, "Control Information For Packet Header/Tail": T4}
diagram:
  case ($"error in (no error)") {
    frame No Error {
      Property Node(instance in=$"Modulation Parameters In") -> ("Control Information For Packet Header/Tail:Zero Pad Length"=w3, "Control Information For Packet Header/Tail:Training Sequence "=w4)
      # Generate zero pad sequences used for packet header
      Initialize Array(element=0, size=w3) -> w5
      Property Node(instance in=$"Modulation Parameters In", "Modulation Type"="BPSK") -> (instance out=w6)
      # Add control information to packet header
      call "modulate.gviprotected"(Modulation Parameters In=w6, input bit stream=w5) -> (output symbols=w7)
      # Generate training sequences used for packet header
      case (w4) {
        frame "(3,4)-Frank Sequence" {
          # Q=
          Square(x=4) -> w9
          for (N = w9) (iteration -> i1) {
            Quotient And Remainder(x=i1, y=4) -> (floor(x/y)=w12, x-y*floor(x/y)=w13)
            append w13 to w10
            append w12 to w11
          }
          Reciprocal(x=4) -> w14
          # R=
          Multiply(PiTimes2, 3, w10, w11, w14) -> w15
          # symbol energy is 1
          Polar To Complex(r=1, theta=w15) -> (r * e^(i*theta)=w16)
          Insert Into Array(inArray=w16, index0=0, new=w16) -> w8
        }
        frame "Neumann Hoffman Binary Code" {
          Property Node(instance in=$"Modulation Parameters In", "Modulation Type"="QPSK") -> (instance out=w17)
          Property Node(instance in=$"Training Sequences") -> ("Neumann Hoffman Binary Code"=w18)
          Insert Into Array(inArray=w18, new=w18, new=w18, new=w18) -> w19
          # Replicate sequence
          # for I&Q phases
          Interleave Array(w19, w19) -> w20
          # Apply QPSK modulation
          call "modulate.gviprotected"(Modulation Parameters In=w17, input bit stream=w20) -> (output symbols=w8)
        }
        frame "Length 11 Barker Sequence", Default {
          Property Node(instance in=$"Modulation Parameters In", "Modulation Type"="QPSK") -> (instance out=w21)
          # Duplicate Barker Sequence
          Property Node(instance in=$"Training Sequences") -> ("Length 11 Barker Sequence"=w22)
          Insert Into Array(inArray=w22, new=w22, new=w22, new=w22) -> w23
          # Replicate sequence
          # for I&Q phases
          Interleave Array(w23, w23) -> w24
          # Apply QPSK modulation
          call "modulate.gviprotected"(Modulation Parameters In=w21, input bit stream=w24) -> (output symbols=w8)
        }
      }
      Insert Into Array(inArray=w7, index0=0, new=w8, new=$input) -> w25
      Insert Into Array(inArray=w25, index0=0, new=w7) -> w26
      # Add guard band to front of packet
      $output <- w26
      # Add training sequence and zero pad sequence
      $"training symbols" <- w8
      w1 = $"error in (no error)"
      w2 = $"Modulation Parameters In"
    }
    frame Error {
      w1 = $"error in (no error)"
      w2 = $"Modulation Parameters In"
    }
  }
  $"Modulation Parameters Out" <- w2
  $"error out" <- w1
