vi "align_ELgate.gvi"   [LabVIEW NXG]
inputs:
  "Modulation Parameters In": T6 = {"Modulation Type"="QPSK", "Control Information\nfor Packet Header/Tail"={"Training Sequence (derived)"=[], "Zero Pad Length"=0}, "RX Oversample Factor"=20, "Synchronization Options"={"Synchronization Method"="Timing Estimation", "Fixed Offset"=0, "Symbol Timing Recovery Method"="Max Energy", "Frame Detection Method"="Sliding Correlator", "Frequency Estimation Method"="", "Correct Frequency Offset"=FALSE, "Correct Symbol Timing"=FALSE}, "Number of Data Symbols (Derived)"=100, "RX Sample Rate"=4000000, "Pulse Shaping Parameters"={"Modulation Type"="PSK", "Pulse Shaping Filter"="Root Raised Cos", "Filter Parameter"=0.5, "Filter Length (Symbols)"=8}, "Channel Estimation/Equalization Parameters"={"Equalization Method"="Direct", "Channel Estimate Length"=1, "Equalizer Length"=1, "Equalizer Delay"=-1, "Equalize"=FALSE}}
  "Input Complex Waveform": cluster{"t0": f64, "dt": f64, "Y": c128[]} = {"t0"=0, "dt"=1, "Y"=[]}
outputs:
  "Modulation Parameters Out": T6
  "Aligned Complex Waveform": cluster{"t0": f64, "dt": f64, "Y": c128[]}
  "Alignment Offset (Samples)": i32
types:
  T1 = cluster{"Training Sequence (derived)": c128[], "Zero Pad Length": i32}
  T2 = cluster{"Synchronization Method": string, "Fixed Offset": i32, "Symbol Timing Recovery Method": string, "Frame Detection Method": string, "Frequency Estimation Method": string, "Correct Frequency Offset": bool, "Correct Symbol Timing": bool}
  T3 = enum{"none", "Raised Cosine", "Root Raised Cos", "Gaussian"}
  T4 = cluster{"Modulation Type": enum{"FSK", "PSK", "QAM", "MSK", "PAM", "ASK"}, "Pulse Shaping Filter": T3, "Filter Parameter": f64, "Filter Length (Symbols)": i32}
  T5 = cluster{"Equalization Method": string, "Channel Estimate Length": i32, "Equalizer Length": i32, "Equalizer Delay": i32, "Equalize": bool}
  T6 = cluster{"Modulation Type": string, "Control Information\nfor Packet Header/Tail": T1, "RX Oversample Factor": i32, "Synchronization Options": T2, "Number of Data Symbols (Derived)": i32, "RX Sample Rate": f64, "Pulse Shaping Parameters": T4, "Channel Estimation/Equalization Parameters": T5}
diagram:
  $"Modulation Parameters Out" <- $"Modulation Parameters In"
  Property Node(instance in=$"Input Complex Waveform") -> (instance out=w1, "Y"=w2)
  Property Node(instance in=$"Modulation Parameters In") -> ("RX Oversample Factor"=w3)
  # 1. Make initial guess for alignment offset
  Random Number() -> (number (0 to 1)=w4)
  Multiply(w4, w3, 2) -> w5
  Round Toward Negative Infinity(x=w5) -> w6
  Property Node(instance in=$"Input Complex Waveform") -> ("Y"=w7)
  Build Array(w6) -> w8
  # 1. Make initial guess for alignment offset
  # 2. Perform Early-Late Gate Algorithm
  # 3. Align waveform according to offset
  # 2. Perform Early-Late Gate Algorithm
  # RX oversample factor
  s1 = w6  # shift register
  s2 = w8  # shift register
  while {
    Increment(x=s1) -> w9
    Decrement(x=s1) -> w10
    # On-time Gate
    Array Subset(array=w7, index0=s1) -> w11
    call "Decimate (single shot, CDB).gvi"(x=w11, decimating factor=w3) -> (decimated array=w12)
    Complex To Real Imaginary(x + iy=w12) -> (x=w13)
    Divide(x=w3, y=2) -> w14
    # keep history of offsets & stop
    # when offset is repeated
    Round Toward Negative Infinity(x=w14) -> w15
    Subtract(x=s1, y=w15) -> w16
    # Early Gate
    Array Subset(array=w7, index0=w16) -> w17
    Add(s1, w15) -> w18
    # Late Gate
    Array Subset(array=w7, index0=w18) -> w19
    Subtract(x=w19, y=w17) -> w20
    call "Decimate (single shot, CDB).gvi"(x=w20, decimating factor=w3) -> (decimated array=w21)
    Complex To Real Imaginary(x + iy=w21) -> (x=w22)
    Multiply(w13, w22) -> w23
    # CREATE ERROR METRIC
    call "Mean (DBL).gvi"(X=w23) -> (mean=w24)
    Is Greater Than 0(x=w24) -> w25
    Select(s=w25, t=w9, f=w10) -> w26
    Is Not Equal To 0(x=w24) -> w27
    Select(s=w27, t=w26, f=s1) -> w28
    Multiply(w3, 2) -> w29
    Quotient And Remainder(x=w28, y=w29) -> (x-y*floor(x/y)=w30)
    Insert Into Array(inArray=s2, new=w30) -> w31
    Search 1D Array(1D array=s2, element=w30) -> (index of element=w32)
    Is Not Equal(x=w32, y=-1) -> w33
    next s1 = w30
    next s2 = w31
    stop if w33
  }
  Quotient And Remainder(x=s1, y=w3) -> (x-y*floor(x/y)=w34)
  Array Subset(array=w2, index0=w34) -> w35
  Property Node(instance in=w1, "Y"=w35) -> (instance out=w36)
  $"Aligned Complex Waveform" <- w36
  # 3. Align waveform according to offset
  $"Alignment Offset (Samples)" <- w34
