vi "align_ELgate_2.gvi"   [LabVIEW NXG]
inputs:
  "Modulation Parameters In": T6 = {"Modulation Type"="QPSK", "Control Information\nfor Packet Header/Tail"={"Training Sequence (derived)"=[], "Zero Pad Length"=0}, "RX Oversample Factor"=20, "Synchronization Options"={"Synchronization Method"="Timing Estimation", "Fixed Offset"=0, "Symbol Timing Recovery Method"="Max Energy", "Frame Detection Method"="Sliding Correlator", "Frequency Estimation Method"="", "Correct Frequency Offset"=FALSE, "Correct Symbol Timing"=FALSE}, "Number of Data Symbols (Derived)"=100, "RX Sample Rate"=4000000, "Pulse Shaping Parameters"={"Modulation Type"="PSK", "Pulse Shaping Filter"="Root Raised Cos", "Filter Parameter"=0.5, "Filter Length (Symbols)"=8}, "Channel Estimation/Equalization Parameters"={"Equalization Method"="Direct", "Channel Estimate Length"=1, "Equalizer Length"=1, "Equalizer Delay"=-1, "Equalize"=FALSE}}
  "Input Complex Waveform": cluster{"t0": f64, "dt": f64, "Y": c128[]} = {"t0"=0, "dt"=1, "Y"=[]}
outputs:
  "Modulation Parameters Out": T6
  "Aligned Complex Waveform": cluster{"t0": f64, "dt": f64, "Y": c128[]}
  "Alignment Offset (Samples)": i32
types:
  T1 = cluster{"Training Sequence (derived)": c128[], "Zero Pad Length": i32}
  T2 = cluster{"Synchronization Method": string, "Fixed Offset": i32, "Symbol Timing Recovery Method": string, "Frame Detection Method": string, "Frequency Estimation Method": string, "Correct Frequency Offset": bool, "Correct Symbol Timing": bool}
  T3 = enum{"none", "Raised Cosine", "Root Raised Cos", "Gaussian"}
  T4 = cluster{"Modulation Type": enum{"FSK", "PSK", "QAM", "MSK", "PAM", "ASK"}, "Pulse Shaping Filter": T3, "Filter Parameter": f64, "Filter Length (Symbols)": i32}
  T5 = cluster{"Equalization Method": string, "Channel Estimate Length": i32, "Equalizer Length": i32, "Equalizer Delay": i32, "Equalize": bool}
  T6 = cluster{"Modulation Type": string, "Control Information\nfor Packet Header/Tail": T1, "RX Oversample Factor": i32, "Synchronization Options": T2, "Number of Data Symbols (Derived)": i32, "RX Sample Rate": f64, "Pulse Shaping Parameters": T4, "Channel Estimation/Equalization Parameters": T5}
diagram:
  call "Decimate (single shot, DBL).gvi"()
  $"Modulation Parameters Out" <- $"Modulation Parameters In"
  Property Node(instance in=$"Input Complex Waveform") -> (instance out=w1, "Y"=w2)
  Property Node(instance in=$"Modulation Parameters In") -> ("RX Oversample Factor"=w3)
  Property Node(instance in=$"Input Complex Waveform") -> ("Y"=w4)
  # 1. Make initial guess for alignment offset
  # 2. Perform Early-Late Gate Algorithm
  # 3. Align waveform according to offset
  # 2. Perform Early-Late Gate Algorithm
  for (N = w3) (iteration -> i1) {
    # On-time Gate
    Array Subset(array=w4, index0=i1) -> w6
    Subtract(x=i1, y=1) -> w7
    # Early Gate
    Array Subset(array=w4, index0=w7) -> w8
    Add(i1, 1) -> w9
    # Late Gate
    Array Subset(array=w4, index0=w9) -> w10
    Subtract(x=w10, y=w8) -> w11
    Multiply(w6, w11) -> w12
    Complex To Real Imaginary(x + iy=w12) -> (x=w13, y=w14)
    # CREATE ERROR METRIC
    Add(w13, w14) -> w15
    call "Decimate (single shot, CDB).gvi"(x=w15, decimating factor=w3) -> (decimated array=w16)
    Add Array Elements(numeric array=w16) -> (sum=w17)
    append w17 to w5
  }
  Complex To Real Imaginary(x + iy=w5) -> (x=w18)
  Square(x=w18) -> w19
  Array Max And Min(array=w19) -> (min index(es)=w20)
  # 3. Align waveform according to offset
  Array Subset(array=w2, index0=w20) -> w21
  Property Node(instance in=w1, "Y"=w21) -> (instance out=w22)
  $"Aligned Complex Waveform" <- w22
  $"Alignment Offset (Samples)" <- w20
