vi "align_Gardner.gvi"   [LabVIEW NXG]
inputs:
  "Modulation Parameters In": T6 = {"Modulation Type"="QPSK", "Control Information\nfor Packet Header/Tail"={"Training Sequence (derived)"=[], "Zero Pad Length"=0}, "RX Oversample Factor"=20, "Synchronization Options"={"Synchronization Method"="Timing Estimation", "Fixed Offset"=0, "Symbol Timing Recovery Method"="Max Energy", "Frame Detection Method"="Sliding Correlator", "Frequency Estimation Method"="", "Correct Frequency Offset"=FALSE, "Correct Symbol Timing"=FALSE}, "Number of Data Symbols (Derived)"=100, "RX Sample Rate"=4000000, "Pulse Shaping Parameters"={"Modulation Type"="PSK", "Pulse Shaping Filter"="Root Raised Cos", "Filter Parameter"=0.5, "Filter Length (Symbols)"=8}, "Channel Estimation/Equalization Parameters"={"Equalization Method"="Direct", "Channel Estimate Length"=1, "Equalizer Length"=1, "Equalizer Delay"=-1, "Equalize"=FALSE}}
  "Input Complex Waveform": cluster{"t0": f64, "dt": f64, "Y": c128[]} = {"t0"=0, "dt"=1, "Y"=[]}
  "error in (no error)": error
outputs:
  "Alignment Offset (Samples)": i32
  "Aligned Complex Waveform": cluster{"t0": f64, "dt": f64, "Y": c128[]}
  "Modulation Parameters Out": T6
  "error out": error
types:
  T1 = cluster{"Training Sequence (derived)": c128[], "Zero Pad Length": i32}
  T2 = cluster{"Synchronization Method": string, "Fixed Offset": i32, "Symbol Timing Recovery Method": string, "Frame Detection Method": string, "Frequency Estimation Method": string, "Correct Frequency Offset": bool, "Correct Symbol Timing": bool}
  T3 = enum{"none", "Raised Cosine", "Root Raised Cos", "Gaussian"}
  T4 = cluster{"Modulation Type": enum{"FSK", "PSK", "QAM", "MSK", "PAM", "ASK"}, "Pulse Shaping Filter": T3, "Filter Parameter": f64, "Filter Length (Symbols)": i32}
  T5 = cluster{"Equalization Method": string, "Channel Estimate Length": i32, "Equalizer Length": i32, "Equalizer Delay": i32, "Equalize": bool}
  T6 = cluster{"Modulation Type": string, "Control Information\nfor Packet Header/Tail": T1, "RX Oversample Factor": i32, "Synchronization Options": T2, "Number of Data Symbols (Derived)": i32, "RX Sample Rate": f64, "Pulse Shaping Parameters": T4, "Channel Estimation/Equalization Parameters": T5}
diagram:
  $"Modulation Parameters Out" <- $"Modulation Parameters In"
  case ($"error in (no error)") {
    frame No Error {
      # Align waveform according to offset
      Property Node(instance in=$"Input Complex Waveform") -> (instance out=w2, "Y"=w3)
      Property Node(instance in=$"Modulation Parameters In") -> ("RX Oversample Factor"=w4)
      Property Node(instance in=$"Input Complex Waveform") -> ("Y"=w5)
      Random Number() -> (number (0 to 1)=w6)
      Multiply(w6, w4, 2) -> w7
      # Initial alignment offset guess
      Round Toward Negative Infinity(x=w7) -> w8
      To Long Integer(number=w8) -> w9
      # Samples per symbol
      Build Array(w9) -> w10
      # Input complex waveform
      # Perform Gardner Algorithm
      # Samples per symbol
      s1 = w9  # shift register
      s2 = w10  # shift register
      while {
        Increment(x=s1) -> w11
        Decrement(x=s1) -> w12
        # On-time Gate
        Array Subset(array=w5, index0=s1) -> w13
        call "Decimate (single shot, CDB).gvi"(x=w13, decimating factor=w4) -> (decimated array=w14)
        Complex To Real Imaginary(x + iy=w14) -> (x=w15, y=w16)
        Divide(x=w4, y=2) -> w17
        Subtract(x=s1, y=w17) -> w18
        # Early Gate
        Array Subset(array=w5, index0=w18) -> w19
        Add(s1, w17) -> w20
        # Late Gate
        Array Subset(array=w5, index0=w20) -> w21
        Subtract(x=w21, y=w19) -> w22
        call "Decimate (single shot, CDB).gvi"(x=w22, decimating factor=w4) -> (decimated array=w23)
        Complex To Real Imaginary(x + iy=w23) -> (x=w24, y=w25)
        Multiply(w15, w24) -> w26
        Multiply(w16, w25) -> w27
        Add(w26, w27) -> w28
        # CREATE ERROR METRIC
        call "Mean (DBL).gvi"(X=w28) -> (mean=w29)
        Is Greater Than 0(x=w29) -> w30
        # keep history of offsets & stop
        # when offset is repeated
        Select(s=w30, t=w11, f=w12) -> w31
        Is Not Equal To 0(x=w29) -> w32
        Select(s=w32, t=w31, f=s1) -> w33
        Multiply(w4, 2) -> w34
        Quotient And Remainder(x=w33, y=w34) -> (x-y*floor(x/y)=w35)
        Insert Into Array(inArray=s2, new=w35) -> w36
        Search 1D Array(1D array=s2, element=w35) -> (index of element=w37)
        Is Not Equal(x=w37, y=-1) -> w38
        next s1 = w35
        next s2 = w36
        stop if w38
      }
      Quotient And Remainder(x=s1, y=w4) -> (x-y*floor(x/y)=w39)
      Array Subset(array=w3, index0=w39) -> w40
      Property Node(instance in=w2, "Y"=w40) -> (instance out=w41)
      $"Aligned Complex Waveform" <- w41
      $"Alignment Offset (Samples)" <- w39
      w1 = $"error in (no error)"
    }
    frame Error {
      w1 = $"error in (no error)"
    }
  }
  $"error out" <- w1
