vi "awgn_channel.gvi"   [LabVIEW NXG]
inputs:
  "input": c128[]
  "noise power (dB)": f64
  "error in (no error)": error
outputs:
  "output": c128[]
  "error out": error
diagram:
  # Add gaussian noise to input
  case ($"error in (no error)") {
    frame No Error {
      Array Size(array=$input) -> (size(s)=w2)
      Divide(x=$"noise power (dB)", y=10) -> w3
      Power Of 10(x=w3) -> w4
      Divide(x=w4, y=2) -> w5
      Square Root(x=w5) -> w6
      call "Gaussian White Noise.gvi"(samples=w2, standard deviation=w6) -> (gaussian noise pattern=w7)
      call "Gaussian White Noise.gvi"(samples=w2, standard deviation=w6) -> (gaussian noise pattern=w8)
      Real And Imaginary To Complex(x=w7, y=w8) -> w9
      Add($input, w9) -> w10
      $output <- w10
      w1 = $"error in (no error)"
    }
    frame Error {
      w1 = $"error in (no error)"
    }
  }
  $"error out" <- w1
