vi "channel.gvi"   [LabVIEW NXG]
inputs:
  "Modulation Parameters In": T5 = {"Modulation Type"="QPSK", "Pulse Shaping Parameters"={"Modulation Type"="PSK", "Pulse Shaping Filter"="Raised Cosine", "Filter Parameter"=0.5, "Filter Length (Symbols)"=8}, "TX Oversample Factor"=20, "Packet Length (Bits)"=500, "TX Sample Rate"=100, "Control Information For Packet Header/Tail"={"Training Sequence "="Length 11 Barker Sequence", "Zero Pad Length"=8}}
  "Input Complex Waveform": cluster{"t0": f64, "dt": f64, "Y": c128[]}
  "Channel Model Parameters": T1 = {"Noise Power (dB)"=-Inf, "Channel Response"=[], "Frequency Offset"=0, "Delay (sec)"=0, "Channel Model"="AWGN"}
  "error in (no error)": error
outputs:
  "Output Complex Waveform": cluster{"t0": f64, "dt": f64, "Y": c128[]}
  "Actual Delay (Sec)": f64
  "error out": error
types:
  T1 = cluster{"Noise Power (dB)": f64, "Channel Response": c128[], "Frequency Offset": f64, "Delay (sec)": f64, "Channel Model": string}
  T2 = enum{"none", "Raised Cosine", "Root Raised Cos", "Gaussian"}
  T3 = cluster{"Modulation Type": enum{"FSK", "PSK", "QAM", "MSK", "PAM", "ASK"}, "Pulse Shaping Filter": T2, "Filter Parameter": f64, "Filter Length (Symbols)": i32}
  T4 = cluster{"Training Sequence ": string, "Zero Pad Length": i32}
  T5 = cluster{"Modulation Type": string, "Pulse Shaping Parameters": T3, "TX Oversample Factor": i32, "Packet Length (Bits)": i32, "TX Sample Rate": f64, "Control Information For Packet Header/Tail": T4}
diagram:
  # 1. apply integer delay offset
  # 2. apply fractional offset
  # 3. apply artificial channel
  # 4. apply artificial frequency offset
  case ($"error in (no error)") {
    frame No Error {
      Property Node(instance in=$"Modulation Parameters In") -> ("TX Sample Rate"=w2, "TX Oversample Factor"=w3)
      Property Node(instance in=$"Channel Model Parameters") -> ("Channel Model"=w4, "Channel Response"=w5, "Noise Power (dB)"=w6, "Frequency Offset"=w7, "Delay (sec)"=w8)
      Divide(x=w2, y=w3) -> w9
      Property Node(instance in=$"Input Complex Waveform") -> ("Y"=w10, "dt"=w11)
      Reciprocal(x=w11) -> w12
      # sym period
      Reciprocal(x=w9) -> w13
      Is Less Than 0(x=w8) -> w14
      # sample period
      # oversample
      # factor
      case (w14) {
        frame False, Default {
          w15 = w8
        }
        frame True {
          Random Number() -> (number (0 to 1)=w16)
          Multiply(w16, w13) -> w15
        }
      }
      Quotient And Remainder(x=w15, y=w11) -> (x-y*floor(x/y)=w17)
      Divide(x=w17, y=w11) -> w18
      Round Toward Positive Infinity(x=w18) -> w19
      Subtract(x=w19, y=w18) -> w20
      # sample rate
      Multiply(w20, w11) -> w21
      Divide(x=w15, y=w11) -> w22
      Round Toward Positive Infinity(x=w22) -> w23
      To Long Integer(number=w23) -> w24
      # 1. apply integer delay offset
      # delay offset
      Initialize Array(element=0+0i, size=w24) -> w25
      # symbol rate
      Insert Into Array(inArray=w10, index0=0, new=w25) -> w26
      # fractional offset
      Property Node(instance in=$"Input Complex Waveform", "Y"=w26) -> (instance out=w27)
      # 2. apply fractional offset
      call "MT Resample (Complex Cluster).gvi"(input complex waveform=w27, desired sample rate=w12, initial sample offset=w21) -> (output complex waveform=w28)
      Property Node(instance in=w28) -> ("Y"=w29)
      # 3. apply artificial channel
      case (w4) {
        frame "AWGN", Default {
          call "awgn_channel.gviprotected"(input=w29, noise power (dB)=w6) -> (output=w30)
        }
        frame "ISI" {
          call "Upsample (CDB).gvi"(x=w5, upsampling factor=w3) -> (upsampled array=w31)
          call "1D Convolution (CDB).gvi"(x=w29, y=w31) -> (x * y=w32)
          call "awgn_channel.gviprotected"(input=w32, noise power (dB)=w6) -> (output=w30)
        }
      }
      call "add_freq_offset.gviprotected"(input=w30, symbol rate (Hz)=w9, frequency offset=w7, samples per symbol=w3) -> (output=w33)
      # 4. apply artificial
      # frequency offset
      Property Node(instance in=$"Input Complex Waveform", "Y"=w33) -> (instance out=w34)
      $"Output Complex Waveform" <- w34
      $"Actual Delay (Sec)" <- w15
      w1 = $"error in (no error)"
    }
    frame Error {
      w1 = $"error in (no error)"
    }
  }
  $"error out" <- w1
