vi "direct_equalizer.gvi"   [LabVIEW NXG]
inputs:
  "Modulation Parameters In": T6 = {"Modulation Type"="QPSK", "Control Information\nfor Packet Header/Tail"={"Training Sequence (derived)"=[], "Zero Pad Length"=0}, "RX Oversample Factor"=20, "Synchronization Options"={"Synchronization Method"="Timing Estimation", "Fixed Offset"=0, "Symbol Timing Recovery Method"="Max Energy", "Frame Detection Method"="Sliding Correlator", "Frequency Estimation Method"="", "Correct Frequency Offset"=FALSE, "Correct Symbol Timing"=FALSE}, "Number of Data Symbols (Derived)"=100, "RX Sample Rate"=4000000, "Pulse Shaping Parameters"={"Modulation Type"="PSK", "Pulse Shaping Filter"="Root Raised Cos", "Filter Parameter"=0.5, "Filter Length (Symbols)"=8}, "Channel Estimation/Equalization Parameters"={"Equalization Method"="Direct", "Channel Estimate Length"=1, "Equalizer Length"=1, "Equalizer Delay"=-1, "Equalize"=FALSE}}
  "Input": c128[]
  "Equalizer Delay": i32
  "error in (no error)": error
outputs:
  "Modulation Parameters Out": T6
  "Filter Estimate": c128[]
  "Mean-Squared Error": f64
  "Actual Equalizer Delay": i32
  "error out": error
panel indicators:
  "Error Code": i32
types:
  T1 = cluster{"Training Sequence (derived)": c128[], "Zero Pad Length": i32}
  T2 = cluster{"Synchronization Method": string, "Fixed Offset": i32, "Symbol Timing Recovery Method": string, "Frame Detection Method": string, "Frequency Estimation Method": string, "Correct Frequency Offset": bool, "Correct Symbol Timing": bool}
  T3 = enum{"none", "Raised Cosine", "Root Raised Cos", "Gaussian"}
  T4 = cluster{"Modulation Type": enum{"FSK", "PSK", "QAM", "MSK", "PAM", "ASK"}, "Pulse Shaping Filter": T3, "Filter Parameter": f64, "Filter Length (Symbols)": i32}
  T5 = cluster{"Equalization Method": string, "Channel Estimate Length": i32, "Equalizer Length": i32, "Equalizer Delay": i32, "Equalize": bool}
  T6 = cluster{"Modulation Type": string, "Control Information\nfor Packet Header/Tail": T1, "RX Oversample Factor": i32, "Synchronization Options": T2, "Number of Data Symbols (Derived)": i32, "RX Sample Rate": f64, "Pulse Shaping Parameters": T4, "Channel Estimation/Equalization Parameters": T5}
diagram:
  $"Modulation Parameters Out" <- $"Modulation Parameters In"
  case ($"error in (no error)") {
    frame No Error {
      Property Node(instance in=$"Modulation Parameters In") -> ("Channel Estimation/Equalization Parameters:Equalizer Length"=w2, "Control Information\nfor Packet Header/Tail:Training Sequence (derived)"=w3)
      # Restrict delay to valid values
      Quotient And Remainder(x=$"Equalizer Delay", y=w2) -> (x-y*floor(x/y)=w4)
      $"Actual Equalizer Delay" <- w4
      Subtract(x=w2, y=w4) -> w5
      Decrement(x=w5) -> w6
      # zero pad the input as necessary
      Initialize Array(element=0+0i, size=w6) -> w7
      Increment(x=w4) -> w8
      Array Subset(array=$Input, index0=0, length0=w8) -> w9
      # Construct Input Matrix Y
      # grab first n_d+1 samples
      Reverse 1D Array(array=w9) -> (reversed array=w10)
      # Input Matrix row
      Build Array[ConcatenateInputs=True](w10, w7) -> w11
      # grab N_t symbols starting at n_d
      Array Size(array=w3) -> (size(s)=w12)
      Quotient And Remainder(x=w12, y=2) -> (floor(x/y)=w13)
      # Input Matrix (has full rank)
      Array Subset(array=$Input, index0=w4, length0=w13) -> w14
      call "make_Toeplitz.gvi"(row=w11, column=w14) -> (Toeplitz Array=w15)
      # Input Matrix column
      # Training Vector
      Array Subset(array=w3, index0=0, length0=w13) -> w16
      # Compute MMSE estimate of equalizing filter for given delay
      call "mmse_linear.gvi"(A=w15, b=w16) -> (x.estimate=w17, mean square error=w18, error code=w19)
      # Make MMSE estimate of equalizing filter based on channel estimate
      $"Filter Estimate" <- w17
      $"Mean-Squared Error" <- w18
      $"Error Code" <- w19
      call "Error Cluster From Error Code.gvi"(error code (0)=w19, error in (no error)=$"error in (no error)") -> (Error Out=w1)
    }
    frame Error {
      w1 = $"error in (no error)"
    }
  }
  $"error out" <- w1
