vi "make_Toeplitz.gvi"   [LabVIEW NXG]
inputs:
  "row": c128[]
  "column": c128[]
outputs:
  "Toeplitz Array": c128[][]
diagram:
  Array Size(array=$row) -> (size(s)=w1)
  Array Size(array=$column) -> (size(s)=w2)
  for (N = w1) (iteration -> i1) {
    Array Subset(array=$row, index0=1, length0=i1) -> w4
    Reverse 1D Array(array=w4) -> (reversed array=w5)
    Subtract(x=w2, y=i1) -> w6
    Array Subset(array=$column, index0=0, length0=w6) -> w7
    Build Array[ConcatenateInputs=True](w5, w7) -> w8
    append w8 to w3
  }
  Transpose 2D Array(2D array=w3) -> (transposed array=w9)
  $"Toeplitz Array" <- w9
