vi "receiver_init (SubVI).gvi"   [LabVIEW NXG]
inputs:
  "Modulation Parameters In": T7 = {"Modulation Type"="QPSK", "Control Information\nfor Packet Header/Tail"={"Training Sequence (derived)"=[], "Zero Pad Length"=0}, "RX Oversample Factor"=20, "Synchronization Options"={"Synchronization Method"="Timing Estimation", "Fixed Offset"=0, "Symbol Timing Recovery Method"="Max Energy", "Frame Detection Method"="Sliding Correlator", "Frequency Estimation Method"="", "Correct Frequency Offset"=FALSE, "Correct Symbol Timing"=FALSE}, "Number of Data Symbols (Derived)"=100, "RX Sample Rate"=4000000, "Pulse Shaping Parameters"={"Modulation Type"="PSK", "Pulse Shaping Filter"="Root Raised Cos", "Filter Parameter"=0.5, "Filter Length (Symbols)"=8}, "Channel Estimation/Equalization Parameters"={"Equalization Method"="Direct", "Channel Estimate Length"=1, "Equalizer Length"=1, "Equalizer Delay"=-1, "Equalize"=FALSE}}
  "Queues In": T1
outputs:
  "Modulation Parameters Out": T7
  "Queues Out": T1
  "symbol rate": f64
  "key bit sequence": i8[]
  "overhead offset": i32
types:
  T1 = cluster{"Key Bit Sequence Queue": Queue<u8[]>, "Training Sequence Queue": Queue<c128[]>}
  T2 = cluster{"Training Sequence (derived)": c128[], "Zero Pad Length": i32}
  T3 = cluster{"Synchronization Method": string, "Fixed Offset": i32, "Symbol Timing Recovery Method": string, "Frame Detection Method": string, "Frequency Estimation Method": string, "Correct Frequency Offset": bool, "Correct Symbol Timing": bool}
  T4 = enum{"none", "Raised Cosine", "Root Raised Cos", "Gaussian"}
  T5 = cluster{"Modulation Type": enum{"FSK", "PSK", "QAM", "MSK", "PAM", "ASK"}, "Pulse Shaping Filter": T4, "Filter Parameter": f64, "Filter Length (Symbols)": i32}
  T6 = cluster{"Equalization Method": string, "Channel Estimate Length": i32, "Equalizer Length": i32, "Equalizer Delay": i32, "Equalize": bool}
  T7 = cluster{"Modulation Type": string, "Control Information\nfor Packet Header/Tail": T2, "RX Oversample Factor": i32, "Synchronization Options": T3, "Number of Data Symbols (Derived)": i32, "RX Sample Rate": f64, "Pulse Shaping Parameters": T5, "Channel Estimation/Equalization Parameters": T6}
diagram:
  $"Queues Out" <- $"Queues In"
  Property Node(instance in=$"Queues In") -> ("Key Bit Sequence Queue"=w1, "Training Sequence Queue"=w2)
  Preview Queue Element(queue=w2, timeout in ms (-1)=100) -> (element=w3, error out=w4)
  Property Node(instance in=$"Modulation Parameters In") -> ("Modulation Type"=w5, "RX Sample Rate"=w6, "RX Oversample Factor"=w7)
  Preview Queue Element(error in (no error)=w4, queue=w1, timeout in ms (-1)=100) -> (element=w8)
  Array Size(array=w8) -> (size(s)=w9)
  case (w5) {
    frame "BPSK", Default {
      w10 = w9
    }
    frame "QPSK" {
      Quotient And Remainder(x=w9, y=2) -> (floor(x/y)=w10)
    }
  }
  Property Node(instance in=$"Modulation Parameters In", "Control Information\nfor Packet Header/Tail:Training Sequence (derived)"=w3, "Number of Data Symbols (Derived)"=w10) -> (instance out=w11)
  $"Modulation Parameters Out" <- w11
  $"key bit sequence" <- w8
  Divide(x=w6, y=w7) -> w12
  $"symbol rate" <- w12
  Property Node(instance in=$"Modulation Parameters In") -> ("Pulse Shaping Parameters:Filter Length (Symbols)"=w13, "Pulse Shaping Parameters:Pulse Shaping Filter"=w14, "RX Oversample Factor"=w15)
  call "Compute overhead offset.gvi"(Pulse Shaping Parameters:Filter Length (Symbols)=w13, RX Oversample Factor=w15, Pulse Shaping Parameters:Pulse Shaping Filter=w14) -> (overhead offset=w16)
  $"overhead offset" <- w16
