vi "reveciver_plot_IQ (SubVI).gvi"   [LabVIEW NXG]
inputs:
  "Received IQ waveform": cluster{"t0": f64, "dt": f64, "Y": c128[]}
  "error in": error
outputs:
  "Q": waveform<f64>
  "I": waveform<f64>
  "error out": error
diagram:
  call "MT Get Complex IQ Component.gvi"(IQ data in=$"Received IQ waveform", component choice="I", error in=$"error in") -> (IQ data out=w1, CE component=w2, error out=w3)
  $I <- w2
  call "MT Get Complex IQ Component.gvi"(IQ data in=w1, component choice="Q", error in=w3) -> (CE component=w4, error out=w5)
  $Q <- w4
  $"error out" <- w5
