vi "synchronize.gvi"   [LabVIEW NXG]
inputs:
  "Modulation Parameters In": T7 = {"Modulation Type"="QPSK", "Control Information\nfor Packet Header/Tail"={"Training Sequence (derived)"=[], "Zero Pad Length"=0}, "RX Oversample Factor"=20, "Synchronization Options"={"Synchronization Method"="Timing Estimation", "Fixed Offset"=0, "Symbol Timing Recovery Method"="Max Energy", "Frame Detection Method"="Sliding Correlator", "Frequency Estimation Method"="", "Correct Frequency Offset"=FALSE, "Correct Symbol Timing"=FALSE}, "Number of Data Symbols (Derived)"=100, "RX Sample Rate"=4000000, "Pulse Shaping Parameters"={"Modulation Type"="PSK", "Pulse Shaping Filter"="Root Raised Cos", "Filter Parameter"=0.5, "Filter Length (Symbols)"=8}, "Channel Estimation/Equalization Parameters"={"Equalization Method"="Direct", "Channel Estimate Length"=1, "Equalizer Length"=1, "Equalizer Delay"=-1, "Equalize"=FALSE}}
  "Input Complex Waveform": cluster{"t0": f64, "dt": f64, "Y": c128[]}
  "TX Channel Model Parameters": T1 = {"Noise Power (dB)"=-Inf, "Channel Response"=[], "Frequency Offset"=0, "Delay (sec)"=0, "Channel Model"="AWGN"}
  "error in (no error)": error
outputs:
  "Modulation Parameters Out": T7
  "Output Complex Symbols": c128[]
  "Offset": i32
  "error out": error
  "Intermediate Complex Waveform": cluster{"t0": f64, "dt": f64, "Y": c128[]}
  "Channel Estimate": c128[]
  "Estimated Frequency Offset": f64
types:
  T1 = cluster{"Noise Power (dB)": f64, "Channel Response": c128[], "Frequency Offset": f64, "Delay (sec)": f64, "Channel Model": string}
  T2 = cluster{"Training Sequence (derived)": c128[], "Zero Pad Length": i32}
  T3 = cluster{"Synchronization Method": string, "Fixed Offset": i32, "Symbol Timing Recovery Method": string, "Frame Detection Method": string, "Frequency Estimation Method": string, "Correct Frequency Offset": bool, "Correct Symbol Timing": bool}
  T4 = enum{"none", "Raised Cosine", "Root Raised Cos", "Gaussian"}
  T5 = cluster{"Modulation Type": enum{"FSK", "PSK", "QAM", "MSK", "PAM", "ASK"}, "Pulse Shaping Filter": T4, "Filter Parameter": f64, "Filter Length (Symbols)": i32}
  T6 = cluster{"Equalization Method": string, "Channel Estimate Length": i32, "Equalizer Length": i32, "Equalizer Delay": i32, "Equalize": bool}
  T7 = cluster{"Modulation Type": string, "Control Information\nfor Packet Header/Tail": T2, "RX Oversample Factor": i32, "Synchronization Options": T3, "Number of Data Symbols (Derived)": i32, "RX Sample Rate": f64, "Pulse Shaping Parameters": T5, "Channel Estimation/Equalization Parameters": T6}
diagram:
  $"Modulation Parameters Out" <- $"Modulation Parameters In"
  case ($"error in (no error)") {
    frame No Error {
      # Recover symbol timing, perform frame detection, and estimate frequency offset correction
      Property Node(instance in=$"Modulation Parameters In") -> ("Synchronization Options:Synchronization Method"=w2)
      case (w2) {
        frame "Timing Estimation" {
          call "symbol_timing.gvi"(Modulation Parameters In=$"Modulation Parameters In", Input Complex Waveform=$"Input Complex Waveform", TX Channel Model Parameters=$"TX Channel Model Parameters", error in (no error)=$"error in (no error)") -> (Modulation Parameters Out=w7, Output Complex Waveform=w8, Alignment Offset=w9, error out=w10)
          Property Node(instance in=$"Modulation Parameters In") -> ("RX Oversample Factor"=w11)
          call "frame_detect.gvi"(Modulation Parameters In=w7, Input Complex Waveform=w8, TX Channel Model Parameters=$"TX Channel Model Parameters", error in (no error)=w10, Alignment Offset=w9) -> (Output=w3, Frame Offset=w12, Frequency Offset=w6, error out=w1)
          Multiply(w12, w11) -> w13
          Add(w9, w13) -> w14
          To Long Integer(number=w14) -> w4
          w5 = c128[] []
        }
        frame "Fixed Offset", Default {
          call "symbol_timing.gvi"(Modulation Parameters In=$"Modulation Parameters In", Input Complex Waveform=$"Input Complex Waveform", error in (no error)=$"error in (no error)") -> (Output Complex Waveform=w15, Alignment Offset=w16, error out=w1)
          Property Node(instance in=w15) -> ("Y"=w3)
          To Long Integer(number=w16) -> w4
          w5 = c128[] []
          w6 = 0
        }
        frame "Joint Timing and Channel Estimation" {
          call "joint_estimation.gvi"(Input Complex Waveform=$"Input Complex Waveform", error in (no error)=$"error in (no error)", L1=$"Modulation Parameters In") -> (Recovered Complex Symbols=w3, Frequency Offset=w6, Total Offset=w4, error out=w1, Channel Estimate=w5)
        }
      }
      Property Node(instance in=$"Input Complex Waveform") -> ("Y"=w17)
      Delete From Array(inArray=w17, length (1)=w4, index0=0) -> w18
      Property Node(instance in=$"Input Complex Waveform", "t0"=0, "Y"=w18) -> (instance out=w19)
      # Get intermediate waveform for eye diagram graph
      $"Intermediate Complex Waveform" <- w19
      $"Output Complex Symbols" <- w3
      $"Estimated Frequency Offset" <- w6
      $Offset <- w4
      $"Channel Estimate" <- w5
    }
    frame Error {
      w1 = $"error in (no error)"
    }
  }
  $"error out" <- w1
