vi "transmitter_enque (SubVI).gvi"   [LabVIEW NXG]
inputs:
  "key bit stream": i8[]
  "training symbols": c128[]
  "Queues In": T1
  "error in": error
outputs:
  "Queues Out": T1
  "error out": error
types:
  T1 = cluster{"Key Bit Sequence Queue": Queue<u8[]>, "Training Sequence Queue": Queue<c128[]>}
diagram:
  Property Node(instance in=$"Queues In") -> (instance out=w1, "Key Bit Sequence Queue"=w2, "Training Sequence Queue"=w3)
  $"Queues Out" <- w1
  Enqueue Element At Opposite End(element=$"key bit stream", error in (no error)=$"error in", queue=w2) -> (error out=w4)
  Enqueue Element At Opposite End(element=$"training symbols", error in (no error)=w4, queue=w3) -> (error out=w5)
  $"error out" <- w5
