vi "transmitter_generate_waveforms (SubVI).gvi"   [LabVIEW NXG]
inputs:
  "I/Q (I)": enum{"I", "Q"} = "I"
  "complex waveform": cluster{"t0": f64, "dt": f64, "Y": c128[]} = {"t0"=0, "dt"=1, "Y"=[]}
  "symbol rate (Hz)": f64 = 1
  "Y": c128[]
  "eye length": i32 = 4
outputs:
  "transmitted constellation": T1[]
  "eye diagram": cluster{"t0": f64, "dt": f64, "Y": f64[]}[]
panel controls:
  "Tab": i32
types:
  T1 = cluster{"constellation": f64[], "oversampled data": f64[]}
diagram:
  Reciprocal(x=$"symbol rate (Hz)") -> w1
  call "make_MTwaveform.gvi"(dt=w1, Y=$Y) -> (output MT waveform=w2)
  call "MT Format Constellation.gvi"(waveform=w2) -> (constellation graph=w3)
  $"transmitted constellation" <- w3
  call "MT Format Eye Diagram (complex).gvi"(waveform=$"complex waveform", symbol rate=$"symbol rate (Hz)", eye length=$"eye length", I/Q=$"I/Q (I)") -> (eye diagram=w4)
  $"eye diagram" <- w4
