vi "simulator.gvi"   [LabVIEW NXG]
inputs:
  "# of Iterations": i32 = 100
  "Control Information for Packet Header/Tail": T1 = {"Training Sequence Type"="Length 11 Barker Sequence", "Zero Pad Length"=8}
  "Pulse Shaping Parameters": T2 = {"Modulation Type"="QAM", "Pulse Shaping Filter"="Root Raised Cos", "Filter Parameter"=0.5, "Filter Length (Symbols)"=64}
  "Packet Length (Bits)": i32 = 1000
  "RX Oversample Factor": i32 = 4
  "RX Sample Rate": f64 = 4000000
  "TX Sample Rate": f64 = 4000000
  "TX Oversample Factor": i32 = 4
  "RX HW Parameters": T3 = {"Active Antenna"="RX1", "Carrier Frequency (Hz)"=915000000, "Gain (dB)"=10, "Trigger Level"=0.01, "Bandwidth (Hz)"=915000000, "Reference Position (%)"=10, "Capture Time (s)"=0.0033, "Simulate"=FALSE, "Device IP Address"="192.168.11.2"}
  "TX HW Parameters": T4 = {"Active Antenna"="TX1", "Carrier Frequency (Hz)"=915000000, "Gain (dB)"=10, "Generation Mode"="Simulate", "Device IP Address"="192.168.11.3"}
  "Modulation Type": string = "QPSK"
  "RX Modulation Parameters": T10 = {"Modulation Type"="QPSK", "Control Information\nfor Packet Header/Tail"={"Training Sequence (derived)"=[], "Zero Pad Length"=0}, "RX Oversample Factor"=20, "Synchronization Options"={"Synchronization Method"="Timing Estimation", "Fixed Offset"=0, "Symbol Timing Recovery Method"="Max Energy", "Frame Detection Method"="Sliding Correlator", "Frequency Estimation Method"="", "Correct Frequency Offset"=FALSE, "Correct Symbol Timing"=FALSE}, "Number of Data Symbols (Derived)"=100, "RX Sample Rate"=4000000, "Pulse Shaping Parameters"={"Modulation Type"="PSK", "Pulse Shaping Filter"="Root Raised Cos", "Filter Parameter"=0.5, "Filter Length (Symbols)"=8}, "Channel Estimation/Equalization Parameters"={"Equalization Method"="Direct", "Channel Estimate Length"=1, "Equalizer Length"=1, "Equalizer Delay"=-1, "Equalize"=FALSE}}
  "Channel Estimation/Equalization Parameters": T9 = {"Equalization Method"="Direct", "Channel Estimate Length"=1, "Equalizer Length"=1, "Equalizer Delay"=-1, "Equalize"=TRUE}
  "TX Modulation Parameters": T12 = {"Modulation Type"="QPSK", "Pulse Shaping Parameters"={"Modulation Type"="PSK", "Pulse Shaping Filter"="Root Raised Cos", "Filter Parameter"=0.5, "Filter Length (Symbols)"=8}, "TX Oversample Factor"=20, "Packet Length (Bits)"=500, "TX Sample Rate"=100, "Control Information For Packet Header/Tail"={"Training Sequence "="Length 11 Barker Sequence", "Zero Pad Length"=8}}
  "Synchronization Options": T6 = {"Synchronization Method"="Timing Estimation", "Fixed Offset"=0, "Symbol Timing Recovery Method"="Ideal alignment", "Frame Detection Method"="Ideal alignment", "Frequency Estimation Method"="Ideal ", "Correct Frequency Offset"=TRUE, "Correct Symbol Timing"=TRUE}
  "Plots": i32
  "TX Channel Model Parameters": T14 = {"Noise Power (dB)"=-Inf, "Channel Response"=[], "Frequency Offset"=0, "Delay (sec)"=0, "Channel Model"="AWGN"}
outputs:
  "error out": error
  "Received Constellation": cluster{"Element 1": f64[], "Element 2": f64[]}[]
  "Received Eye Diagram": cluster{"t0": f64, "dt": f64, "Y": f64[]}[]
  "Power Delay Profile": waveform<f64>
  "Measured Channel Impairements": T13
  "I Data": waveform<f64>
  "Q Data": waveform<f64>
  "Output metrics": T15
panel indicators:
  "Estimated Offset": i32
  "Estimated offset in time": f64
types:
  T1 = cluster{"Training Sequence Type": string, "Zero Pad Length": i32}
  T2 = cluster{"Modulation Type": enum{"FSK", "PSK", "QAM", "MSK", "PAM", "ASK"}, "Pulse Shaping Filter": enum{"none", "Raised Cosine", "Root Raised Cos"}, "Filter Parameter": f64, "Filter Length (Symbols)": i32}
  T3 = cluster{"Active Antenna": string, "Carrier Frequency (Hz)": f64, "Gain (dB)": f64, "Trigger Level": f64, "Bandwidth (Hz)": f64, "Reference Position (%)": f64, "Capture Time (s)": f64, "Simulate": bool, "Device IP Address": string}
  T4 = cluster{"Active Antenna": string, "Carrier Frequency (Hz)": f64, "Gain (dB)": f64, "Generation Mode": enum{"Single Shot", "Simulate", "Continuous"}, "Device IP Address": string}
  T5 = cluster{"Training Sequence (derived)": c128[], "Zero Pad Length": i32}
  T6 = cluster{"Synchronization Method": string, "Fixed Offset": i32, "Symbol Timing Recovery Method": string, "Frame Detection Method": string, "Frequency Estimation Method": string, "Correct Frequency Offset": bool, "Correct Symbol Timing": bool}
  T7 = enum{"none", "Raised Cosine", "Root Raised Cos", "Gaussian"}
  T8 = cluster{"Modulation Type": enum{"FSK", "PSK", "QAM", "MSK", "PAM", "ASK"}, "Pulse Shaping Filter": T7, "Filter Parameter": f64, "Filter Length (Symbols)": i32}
  T9 = cluster{"Equalization Method": string, "Channel Estimate Length": i32, "Equalizer Length": i32, "Equalizer Delay": i32, "Equalize": bool}
  T10 = cluster{"Modulation Type": string, "Control Information\nfor Packet Header/Tail": T5, "RX Oversample Factor": i32, "Synchronization Options": T6, "Number of Data Symbols (Derived)": i32, "RX Sample Rate": f64, "Pulse Shaping Parameters": T8, "Channel Estimation/Equalization Parameters": T9}
  T11 = cluster{"Training Sequence ": string, "Zero Pad Length": i32}
  T12 = cluster{"Modulation Type": string, "Pulse Shaping Parameters": T8, "TX Oversample Factor": i32, "Packet Length (Bits)": i32, "TX Sample Rate": f64, "Control Information For Packet Header/Tail": T11}
  T13 = cluster{"SNR(dB)": f64, "Channel Estimate": c128[], "Freq. Offset": f64, "Delay": f64}
  T14 = cluster{"Noise Power (dB)": f64, "Channel Response": c128[], "Frequency Offset": f64, "Delay (sec)": f64, "Channel Model": string}
  T15 = cluster{"Average Bit Error Rate": f64, "Timing Error Statistic": f64, "Frequency Error Statistic": f64}
diagram:
  call "Adapt noise power.gvi"(TX Channel Model Parameters In=$"TX Channel Model Parameters", Pulse Shaping Parameters=$"Pulse Shaping Parameters", RX Oversample Factor=$"RX Oversample Factor") -> (TX Channel Model Parameters Out=w1)
  Property Node(instance in=$"RX HW Parameters", "Simulate"=TRUE) -> (instance out=w2)
  Property Node(instance in=$"Control Information for Packet Header/Tail") -> ("Zero Pad Length"=w3)
  Property Node(instance in=T5 {all zero or empty}, "Zero Pad Length"=w3) -> (instance out=w4)
  # Ts
  Property Node(instance in=$"RX Modulation Parameters", "Modulation Type"=$"Modulation Type", "Pulse Shaping Parameters"=$"Pulse Shaping Parameters", "Control Information\nfor Packet Header/Tail"=w4, "RX Oversample Factor"=$"RX Oversample Factor", "Channel Estimation/Equalization Parameters"=$"Channel Estimation/Equalization Parameters", "Synchronization Options"=$"Synchronization Options", "RX Sample Rate"=$"RX Sample Rate") -> (instance out=w5)
  Property Node(instance in=$"TX Modulation Parameters", "Modulation Type"=$"Modulation Type", "Pulse Shaping Parameters"=$"Pulse Shaping Parameters", "TX Oversample Factor"=$"TX Oversample Factor", "Packet Length (Bits)"=$"Packet Length (Bits)", "Control Information For Packet Header/Tail"=$"Control Information for Packet Header/Tail", "TX Sample Rate"=$"TX Sample Rate") -> (instance out=w6)
  Property Node(instance in=$"TX HW Parameters", "Generation Mode"="Simulate") -> (instance out=w7)
  Divide(x=$"RX Oversample Factor", y=$"RX Sample Rate") -> w8
  for (N = $"# of Iterations") {
    # IQ Waveform
    call "top_tx.gvi"(HW Parameters=w7, Modulation Parameters=w6, Channel Model Parameters=w1) -> (error out=w12, Output IQ Waveform=w13)
    call "top_rx.gvi"(error in=w12, Received IQ Waveform=w13, HW Parameters=w2, Modulation Parameters=w5, TX Channel Model Parameters=w1) -> (Eye Diagram=w14, Average Bit-Error Rate=w15, I Data=w16, Q Data=w17, Signal Constellation=w18, Measured Channel Impairements=w19, error out=w20, Offset=w21, Power Delay Profile=w22)
    call "Compute error statistics.gvi"(TX Channel Model Parameters=w1, Measured Channel Impairements=w19, RX Modulation Parameters=w5) -> (Timing error statistic=w23, Frequency error statistic=w24)
    $"Measured Channel Impairements" <- w19
    $"I Data" <- w16
    $"Q Data" <- w17
    $"Received Eye Diagram" <- w14
    $"Received Constellation" <- w18
    $"error out" <- w20
    $"Power Delay Profile" <- w22
    $"Estimated Offset" <- w21
    To Double Precision Float(number=w21) -> w25
    Divide(x=w8, y=$"RX Oversample Factor") -> w26
    Multiply(w25, w26) -> w27
    $"Estimated offset in time" <- w27
    append w15 to w9
    append w23 to w10
    append w24 to w11
  }
  call "Mean (DBL).gvi"(X=w10) -> (mean=w28)
  call "Mean (DBL).gvi"(X=w11) -> (mean=w29)
  call "Mean (DBL).gvi"(X=w9) -> (mean=w30)
  Property Node(instance in=T15 {all zero or empty}, "Average Bit Error Rate"=w30, "Timing Error Statistic"=w28, "Frequency Error Statistic"=w29) -> (instance out=w31)
  $"Output metrics" <- w31
