vi "student_matched_filtering.gvi"   [LabVIEW NXG]
inputs:
  "Modulation Parameters In": T6 = {"Modulation Type"="QPSK", "Control Information\nfor Packet Header/Tail"={"Training Sequence (derived)"=[], "Zero Pad Length"=0}, "RX Oversample Factor"=20, "Synchronization Options"={"Synchronization Method"="Timing Estimation", "Fixed Offset"=0, "Symbol Timing Recovery Method"="Max Energy", "Frame Detection Method"="Sliding Correlator", "Frequency Estimation Method"="", "Correct Frequency Offset"=FALSE, "Correct Symbol Timing"=FALSE}, "Number of Data Symbols (Derived)"=100, "RX Sample Rate"=4000000, "Pulse Shaping Parameters"={"Modulation Type"="PSK", "Pulse Shaping Filter"="Root Raised Cos", "Filter Parameter"=0.5, "Filter Length (Symbols)"=8}, "Channel Estimation/Equalization Parameters"={"Equalization Method"="Direct", "Channel Estimate Length"=1, "Equalizer Length"=1, "Equalizer Delay"=-1, "Equalize"=FALSE}}
  "Input Complex Waveform": cluster{"t0": f64, "dt": f64, "Y": c128[]}
  "Error In": error
outputs:
  "Modulation Parameters Out": T6
  "Output Complex Waveform": cluster{"t0": f64, "dt": f64, "Y": c128[]}
  "Error Out": error
types:
  T1 = cluster{"Training Sequence (derived)": c128[], "Zero Pad Length": i32}
  T2 = cluster{"Synchronization Method": string, "Fixed Offset": i32, "Symbol Timing Recovery Method": string, "Frame Detection Method": string, "Frequency Estimation Method": string, "Correct Frequency Offset": bool, "Correct Symbol Timing": bool}
  T3 = enum{"none", "Raised Cosine", "Root Raised Cos", "Gaussian"}
  T4 = cluster{"Modulation Type": enum{"FSK", "PSK", "QAM", "MSK", "PAM", "ASK"}, "Pulse Shaping Filter": T3, "Filter Parameter": f64, "Filter Length (Symbols)": i32}
  T5 = cluster{"Equalization Method": string, "Channel Estimate Length": i32, "Equalizer Length": i32, "Equalizer Delay": i32, "Equalize": bool}
  T6 = cluster{"Modulation Type": string, "Control Information\nfor Packet Header/Tail": T1, "RX Oversample Factor": i32, "Synchronization Options": T2, "Number of Data Symbols (Derived)": i32, "RX Sample Rate": f64, "Pulse Shaping Parameters": T4, "Channel Estimation/Equalization Parameters": T5}
diagram:
  $"Modulation Parameters Out" <- $"Modulation Parameters In"
  case ($"Error In") {
    frame No Error, Default {
      Property Node(instance in=$"Input Complex Waveform") -> ("Y"=w3)  # Cluster Properties
      Property Node(instance in=$"Modulation Parameters In") -> ("Pulse Shaping Parameters:Modulation Type"=w4, "Pulse Shaping Parameters:Pulse Shaping Filter"=w5, "RX Oversample Factor"=w6, "Pulse Shaping Parameters:Filter Parameter"=w7, "Pulse Shaping Parameters:Filter Length (Symbols)"=w8)
      call "MT Generate Filter Coefficients.gvi"(pulse shaping filter=w5, matched samples per symbol=w6, filter parameter=w7, modulation type=w4, filter length=w8) -> (matched filter coefficients=w9)
      call "1D Convolution (CDB).gvi"(x=w3, y=w9) -> (x * y=w10)  # Convolution.gvi
      Property Node(instance in=$"Input Complex Waveform", "Y"=w10) -> (instance out=w2)  # Cluster Properties
      w1 = $"Error In"
    }
    frame Error {
      w1 = $"Error In"
      w2 = $"Input Complex Waveform"
    }
  }
  $"Output Complex Waveform" <- w2
  $"Error Out" <- w1
