vi "student_modulate.gvi"   [LabVIEW NXG]
inputs:
  "Modulation Parameters In": T4 = {"Modulation Type"="QPSK", "Pulse Shaping Parameters"={"Modulation Type"="PSK", "Pulse Shaping Filter"="Root Raised Cos", "Filter Parameter"=0.5, "Filter Length (Symbols)"=8}, "TX Oversample Factor"=20, "Packet Length (Bits)"=500, "TX Sample Rate"=100, "Control Information For Packet Header/Tail"={"Training Sequence "="Length 11 Barker Sequence", "Zero Pad Length"=8}}
  "Input Bit Stream": u8[]
  "Error In": error
outputs:
  "Modulation Parameters Out": T4
  "Output Symbols": c128[]
  "Error Out": error
types:
  T1 = enum{"none", "Raised Cosine", "Root Raised Cos", "Gaussian"}
  T2 = cluster{"Modulation Type": enum{"FSK", "PSK", "QAM", "MSK", "PAM", "ASK"}, "Pulse Shaping Filter": T1, "Filter Parameter": f64, "Filter Length (Symbols)": i32}
  T3 = cluster{"Training Sequence ": string, "Zero Pad Length": i32}
  T4 = cluster{"Modulation Type": string, "Pulse Shaping Parameters": T2, "TX Oversample Factor": i32, "Packet Length (Bits)": i32, "TX Sample Rate": f64, "Control Information For Packet Header/Tail": T3}
diagram:
  $"Modulation Parameters Out" <- $"Modulation Parameters In"
  case ($"Error In") {
    frame No Error, Default {
      Property Node(instance in=$"Modulation Parameters In") -> ("Modulation Type"=w3)
      case (w3) {
        frame "BPSK", Default {
          To Double Precision Float(number=$"Input Bit Stream") -> w4
          Multiply(w4, 2) -> w5
          Subtract(x=w5, y=1) -> w2
        }
        frame "QPSK" {
          Square Root(x=2) -> w6
          Decimate Array(array=$"Input Bit Stream") -> (out0=w7, out1=w8)
          To Double Precision Float(number=w8) -> w9
          Multiply(w9, 2) -> w10
          Subtract(x=w10, y=1) -> w11
          Divide(x=w11, y=w6) -> w12
          Square Root(x=2) -> w13
          To Double Precision Float(number=w7) -> w14
          Multiply(w14, 2) -> w15
          Subtract(x=w15, y=1) -> w16
          Divide(x=w16, y=w13) -> w17
          Real And Imaginary To Complex(x=w17, y=w12) -> w2
        }
      }
      w1 = $"Error In"
    }
    frame Error {
      w1 = $"Error In"
      w2 = c128[] []
    }
  }
  $"Output Symbols" <- w2
  $"Error Out" <- w1
