vi "student_pulse_shaping.gvi"   [LabVIEW NXG]
inputs:
  "Modulation Parameters In": T4 = {"Modulation Type"="QPSK", "Pulse Shaping Parameters"={"Modulation Type"="PSK", "Pulse Shaping Filter"="Root Raised Cos", "Filter Parameter"=0.5, "Filter Length (Symbols)"=8}, "TX Oversample Factor"=20, "Packet Length (Bits)"=500, "TX Sample Rate"=100, "Control Information For Packet Header/Tail"={"Training Sequence "="Length 11 Barker Sequence", "Zero Pad Length"=8}}
  "Input": c128[]
  "Error In": error
outputs:
  "Modulation Parameters Out": T4
  "Output": c128[]
  "Filter Coefficients": f64[]
  "Error Out": error
types:
  T1 = enum{"none", "Raised Cosine", "Root Raised Cos", "Gaussian"}
  T2 = cluster{"Modulation Type": enum{"FSK", "PSK", "QAM", "MSK", "PAM", "ASK"}, "Pulse Shaping Filter": T1, "Filter Parameter": f64, "Filter Length (Symbols)": i32}
  T3 = cluster{"Training Sequence ": string, "Zero Pad Length": i32}
  T4 = cluster{"Modulation Type": string, "Pulse Shaping Parameters": T2, "TX Oversample Factor": i32, "Packet Length (Bits)": i32, "TX Sample Rate": f64, "Control Information For Packet Header/Tail": T3}
diagram:
  $"Modulation Parameters Out" <- $"Modulation Parameters In"
  case ($"Error In") {
    frame No Error, Default {
      Property Node(instance in=$"Modulation Parameters In") -> ("Pulse Shaping Parameters:Modulation Type"=w4, "Pulse Shaping Parameters:Pulse Shaping Filter"=w5, "TX Oversample Factor"=w6, "Pulse Shaping Parameters:Filter Parameter"=w7, "Pulse Shaping Parameters:Filter Length (Symbols)"=w8)
      call "Upsample (CDB).gvi"(x=$Input, upsampling factor=w6) -> (upsampled array=w9)  # Upsample.gvi
      call "MT Generate Filter Coefficients.gvi"(pulse shaping filter=w5, pulse shaping samples per symbol=w6, filter parameter=w7, modulation type=w4, filter length=w8) -> (pulse shaping filter coefficients=w3)
      call "1D Convolution (CDB).gvi"(x=w3, y=w9) -> (x * y=w2)  # Convolution.gvi
      w1 = $"Error In"
    }
    frame Error {
      w1 = $"Error In"
      w2 = c128[] []
      w3 = f64[] []
    }
  }
  $"Filter Coefficients" <- w3
  $Output <- w2
  $"Error Out" <- w1
