vi "Adapt noise power.gvi"   [LabVIEW NXG]
inputs:
  "TX Channel Model Parameters In": T1 = {"Noise Power (dB)"=-Inf, "Channel Response"=[], "Frequency Offset"=0, "Delay (sec)"=0, "Channel Model"="AWGN"}
  "Pulse Shaping Parameters": T3 = {"Modulation Type"="QAM", "Pulse Shaping Filter"="Root Raised Cos", "Filter Parameter"=0.5, "Filter Length (Symbols)"=8}
  "RX Oversample Factor": i32 = 4
outputs:
  "TX Channel Model Parameters Out": T1
types:
  T1 = cluster{"Noise Power (dB)": f64, "Channel Response": c128[], "Frequency Offset": f64, "Delay (sec)": f64, "Channel Model": string}
  T2 = enum{"none", "Raised Cosine", "Root Raised Cos", "Gaussian"}
  T3 = cluster{"Modulation Type": enum{"FSK", "PSK", "QAM", "MSK", "PAM", "ASK"}, "Pulse Shaping Filter": T2, "Filter Parameter": f64, "Filter Length (Symbols)": i32}
diagram:
  Property Node(instance in=$"TX Channel Model Parameters In") -> ("Noise Power (dB)"=w1)
  Property Node(instance in=$"Pulse Shaping Parameters") -> ("Pulse Shaping Filter"=w2)
  case (w2) {
    frame "none", Default {
      Logarithm Base 10(x=$"RX Oversample Factor") -> w4
      Multiply(w4, 10) -> w5
      Add(w1, w5) -> w3
    }
    frame "Raised Cosine" {
      w3 = w1
    }
    frame "Root Raised Cos" {
      Logarithm Base 10(x=$"RX Oversample Factor") -> w6
      Multiply(w6, 10) -> w7
      Add(w1, w7) -> w3
    }
    frame "Gaussian" {
      w3 = w1
    }
  }
  Property Node(instance in=$"TX Channel Model Parameters In", "Noise Power (dB)"=w3) -> (instance out=w8)
  $"TX Channel Model Parameters Out" <- w8
