vi "Compute error statistics.gvi"   [LabVIEW NXG]
inputs:
  "TX Channel Model Parameters": T1 = {"Noise Power (dB)"=-Inf, "Channel Response"=[], "Frequency Offset"=0, "Delay (sec)"=0, "Channel Model"="AWGN"}
  "Measured Channel Impairements": T2 = {"SNR(dB)"=89.8475026698, "Channel Estimate"=[1.00000498326+3.07262180878e-06i], "Freq. Offset"=-0.072661975816, "Delay"=0}
  "RX Modulation Parameters": T8 = {"Modulation Type"="QPSK", "Control Information\nfor Packet Header/Tail"={"Training Sequence (derived)"=[], "Zero Pad Length"=0}, "RX Oversample Factor"=20, "Synchronization Options"={"Synchronization Method"="Timing Estimation", "Fixed Offset"=0, "Symbol Timing Recovery Method"="Max Energy", "Frame Detection Method"="Sliding Correlator", "Frequency Estimation Method"="", "Correct Frequency Offset"=FALSE, "Correct Symbol Timing"=FALSE}, "Number of Data Symbols (Derived)"=100, "RX Sample Rate"=4000000, "Pulse Shaping Parameters"={"Modulation Type"="PSK", "Pulse Shaping Filter"="Root Raised Cos", "Filter Parameter"=0.5, "Filter Length (Symbols)"=8}, "Channel Estimation/Equalization Parameters"={"Equalization Method"="Direct", "Channel Estimate Length"=1, "Equalizer Length"=1, "Equalizer Delay"=-1, "Equalize"=FALSE}}
outputs:
  "Timing error statistic": f64
  "Frequency error statistic": f64
types:
  T1 = cluster{"Noise Power (dB)": f64, "Channel Response": c128[], "Frequency Offset": f64, "Delay (sec)": f64, "Channel Model": string}
  T2 = cluster{"SNR(dB)": f64, "Channel Estimate": c128[], "Freq. Offset": f64, "Delay": f64}
  T3 = cluster{"Training Sequence (derived)": c128[], "Zero Pad Length": i32}
  T4 = cluster{"Synchronization Method": string, "Fixed Offset": i32, "Symbol Timing Recovery Method": string, "Frame Detection Method": string, "Frequency Estimation Method": string, "Correct Frequency Offset": bool, "Correct Symbol Timing": bool}
  T5 = enum{"none", "Raised Cosine", "Root Raised Cos", "Gaussian"}
  T6 = cluster{"Modulation Type": enum{"FSK", "PSK", "QAM", "MSK", "PAM", "ASK"}, "Pulse Shaping Filter": T5, "Filter Parameter": f64, "Filter Length (Symbols)": i32}
  T7 = cluster{"Equalization Method": string, "Channel Estimate Length": i32, "Equalizer Length": i32, "Equalizer Delay": i32, "Equalize": bool}
  T8 = cluster{"Modulation Type": string, "Control Information\nfor Packet Header/Tail": T3, "RX Oversample Factor": i32, "Synchronization Options": T4, "Number of Data Symbols (Derived)": i32, "RX Sample Rate": f64, "Pulse Shaping Parameters": T6, "Channel Estimation/Equalization Parameters": T7}
diagram:
  Property Node(instance in=$"RX Modulation Parameters") -> ("RX Oversample Factor"=w1, "RX Sample Rate"=w2)
  Divide(x=w1, y=w2) -> w3
  Property Node(instance in=$"TX Channel Model Parameters") -> ("Delay (sec)"=w4, "Frequency Offset"=w5)
  Property Node(instance in=$"Measured Channel Impairements") -> ("Delay"=w6, "Freq. Offset"=w7)
  Subtract(x=w4, y=w6) -> w8
  Divide(x=w8, y=w3) -> w9
  Square(x=w9) -> w10
  $"Timing error statistic" <- w10
  Subtract(x=w5, y=w7) -> w11
  Multiply(w11, w3) -> w12
  Absolute Value(x=w12) -> w13
  $"Frequency error statistic" <- w13
