vi "Compute overhead offset.gvi"   [LabVIEW NXG]
inputs:
  "Pulse Shaping Parameters:Filter Length (Symbols)": i32
  "RX Oversample Factor": i32
  "Pulse Shaping Parameters:Pulse Shaping Filter": T1 = "none"
outputs:
  "overhead offset": i32
types:
  T1 = enum{"none", "Raised Cosine", "Root Raised Cos", "Gaussian"}
diagram:
  case ($"Pulse Shaping Parameters:Pulse Shaping Filter") {
    frame "none", Default {
      Decrement(x=$"RX Oversample Factor") -> w1
    }
    frame "Raised Cosine" {
      Multiply($"Pulse Shaping Parameters:Filter Length (Symbols)", $"RX Oversample Factor") -> w2
      Divide(x=w2, y=2) -> w3
      Round Toward Positive Infinity(x=w3) -> w1
    }
    frame "Root Raised Cos" {
      Multiply($"Pulse Shaping Parameters:Filter Length (Symbols)", $"RX Oversample Factor") -> w1
    }
    frame "Gaussian" {
      w1 = 0
    }
  }
  $"overhead offset" <- w1
