vi "Generate filters coefficients.gvi"   [LabVIEW NXG]
inputs:
  "pulse shaping filter": T1 = "none"
  "pulse shaping samples per symbol": i32 = 16
  "matched samples per symbol": i32 = 16
  "Pulse Shaping Parameters:Modulation Type": enum{"FSK", "PSK", "QAM", "MSK", "PAM", "ASK"} = "FSK"
  "filter parameter": f64 = 0.5
  "filter length (symbols)": i32 = 8
  "error in": error
outputs:
  "pulse shaping coefficients": f64[]
  "matched filter coefficients": f64[]
  "error out": error
types:
  T1 = enum{"none", "Raised Cosine", "Root Raised Cos", "Gaussian"}
diagram:
  call "MT Generate Filter Coefficients.gvi"(pulse shaping filter=$"pulse shaping filter", pulse shaping samples per symbol=$"pulse shaping samples per symbol", matched samples per symbol=$"matched samples per symbol", filter parameter=$"filter parameter", error in=$"error in", modulation type=$"Pulse Shaping Parameters:Modulation Type", filter length=$"filter length (symbols)") -> (pulse shaping filter coefficients=w1, matched filter coefficients=w2, error out=w3)
  case ($"pulse shaping filter") {
    frame "none", Default {
      w4 = w1
      w5 = w2
    }
    frame "Raised Cosine" {
      w4 = w1
      w5 = w2
    }
    frame "Root Raised Cos" {
      Square Root(x=$"pulse shaping samples per symbol") -> w6
      Multiply(w1, w6) -> w4
      Square Root(x=$"matched samples per symbol") -> w7
      Divide(x=w2, y=w7) -> w5
    }
    frame "Gaussian" {
      w4 = w1
      w5 = w2
    }
  }
  $"pulse shaping coefficients" <- w4
  $"matched filter coefficients" <- w5
  $"error out" <- w3
