vi "Ideal symbol alignment.gvi"   [LabVIEW NXG]
inputs:
  "Modulation Parameters In": T7 = {"Modulation Type"="QPSK", "Control Information\nfor Packet Header/Tail"={"Training Sequence (derived)"=[], "Zero Pad Length"=0}, "RX Oversample Factor"=20, "Synchronization Options"={"Synchronization Method"="Timing Estimation", "Fixed Offset"=0, "Symbol Timing Recovery Method"="Max Energy", "Frame Detection Method"="Sliding Correlator", "Frequency Estimation Method"="", "Correct Frequency Offset"=FALSE, "Correct Symbol Timing"=FALSE}, "Number of Data Symbols (Derived)"=100, "RX Sample Rate"=4000000, "Pulse Shaping Parameters"={"Modulation Type"="PSK", "Pulse Shaping Filter"="Root Raised Cos", "Filter Parameter"=0.5, "Filter Length (Symbols)"=8}, "Channel Estimation/Equalization Parameters"={"Equalization Method"="Direct", "Channel Estimate Length"=1, "Equalizer Length"=1, "Equalizer Delay"=-1, "Equalize"=FALSE}}
  "Input Complex Waveform": cluster{"t0": f64, "dt": f64, "Y": c128[]} = {"t0"=0, "dt"=1, "Y"=[]}
  "TX Channel Model Parameters": T1 = {"Noise Power (dB)"=-Inf, "Channel Response"=[], "Frequency Offset"=0, "Delay (sec)"=0, "Channel Model"="AWGN"}
outputs:
  "Aligned Complex Waveform": cluster{"t0": f64, "dt": f64, "Y": c128[]}
  "Alignment Offset": f64
panel indicators:
  "x": f64[]
types:
  T1 = cluster{"Noise Power (dB)": f64, "Channel Response": c128[], "Frequency Offset": f64, "Delay (sec)": f64, "Channel Model": string}
  T2 = cluster{"Training Sequence (derived)": c128[], "Zero Pad Length": i32}
  T3 = cluster{"Synchronization Method": string, "Fixed Offset": i32, "Symbol Timing Recovery Method": string, "Frame Detection Method": string, "Frequency Estimation Method": string, "Correct Frequency Offset": bool, "Correct Symbol Timing": bool}
  T4 = enum{"none", "Raised Cosine", "Root Raised Cos", "Gaussian"}
  T5 = cluster{"Modulation Type": enum{"FSK", "PSK", "QAM", "MSK", "PAM", "ASK"}, "Pulse Shaping Filter": T4, "Filter Parameter": f64, "Filter Length (Symbols)": i32}
  T6 = cluster{"Equalization Method": string, "Channel Estimate Length": i32, "Equalizer Length": i32, "Equalizer Delay": i32, "Equalize": bool}
  T7 = cluster{"Modulation Type": string, "Control Information\nfor Packet Header/Tail": T2, "RX Oversample Factor": i32, "Synchronization Options": T3, "Number of Data Symbols (Derived)": i32, "RX Sample Rate": f64, "Pulse Shaping Parameters": T5, "Channel Estimation/Equalization Parameters": T6}
diagram:
  Property Node(instance in=$"Input Complex Waveform") -> (instance out=w1, "Y"=w2)
  Complex To Real Imaginary(x + iy=w2) -> (x=w3)
  $x <- w3
  Property Node(instance in=$"Modulation Parameters In") -> ("RX Oversample Factor"=w4, "RX Sample Rate"=w5, "Pulse Shaping Parameters:Filter Length (Symbols)"=w6, "Pulse Shaping Parameters:Pulse Shaping Filter"=w7)
  call "Compute overhead offset.gvi"(Pulse Shaping Parameters:Filter Length (Symbols)=w6, RX Oversample Factor=w4, Pulse Shaping Parameters:Pulse Shaping Filter=w7) -> (overhead offset=w8)
  Property Node(instance in=$"TX Channel Model Parameters") -> ("Delay (sec)"=w9)
  Divide(x=w4, y=w5) -> w10
  Quotient And Remainder(x=w9, y=w10) -> (x-y*floor(x/y)=w11)
  Multiply(w11, w5) -> w12
  Round To Nearest(number=w12) -> w13
  Add(w13, w8) -> w14
  Quotient And Remainder(x=w14, y=w4) -> (x-y*floor(x/y)=w15)
  Array Subset(array=w2, index0=w15) -> w16
  Property Node(instance in=w1, "Y"=w16) -> (instance out=w17)
  $"Aligned Complex Waveform" <- w17
  $"Alignment Offset" <- w15
