vi "top_rx.gvi"   [LabVIEW NXG]
inputs:
  "# of Receive Iterations": i32 = 1
  "error in": error
  "Received IQ Waveform": cluster{"t0": f64, "dt": f64, "Y": c128[]} = {"t0"=0, "dt"=0.01, "Y"=[-0.0022595636299+2.50015037213e-18i, -0.00223099689251-5.57953480118e-16i, -0.00207189229063-9.03374646181e-16i, -0.00178298015595-8.22901056078e-16i, -0.00137217465826-7.80828213097e-16i, -0.000854524653002-7.23715403033e-16i, -0.000251776460603-7.9934495179e-16i, 0.000408448090976-9.27008880167e-16i, 0.00109383464663-8.26690346485e-16i, 0.00176887648159-1.04334400217e-15i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]}
  "HW Parameters": T1 = {"Active Antenna"="RX1", "Carrier Frequency (Hz)"=915000000, "Gain (dB)"=10, "Trigger Level"=0.01, "Bandwidth (Hz)"=40000000, "Reference Position (%)"=10, "Capture Time (s)"=0.002, "Simulate"=FALSE, "Device IP Address"="192.168.10.2"}
  "Modulation Parameters": T9 = {"Modulation Type"="QPSK", "Control Information\nfor Packet Header/Tail"={"Training Sequence (derived)"=[], "Zero Pad Length"=0}, "RX Oversample Factor"=20, "Synchronization Options"={"Synchronization Method"="Timing Estimation", "Fixed Offset"=0, "Symbol Timing Recovery Method"="Max Energy", "Frame Detection Method"="Sliding Correlator", "Frequency Estimation Method"="", "Correct Frequency Offset"=FALSE, "Correct Symbol Timing"=FALSE}, "Number of Data Symbols (Derived)"=100, "RX Sample Rate"=4000000, "Pulse Shaping Parameters"={"Modulation Type"="PSK", "Pulse Shaping Filter"="Root Raised Cos", "Filter Parameter"=0.5, "Filter Length (Symbols)"=8}, "Channel Estimation/Equalization Parameters"={"Equalization Method"="Direct", "Channel Estimate Length"=1, "Equalizer Length"=1, "Equalizer Delay"=-1, "Equalize"=FALSE}}
  "Stop": bool
  "TX Channel Model Parameters": T3 = {"Noise Power (dB)"=-Inf, "Channel Response"=[], "Frequency Offset"=0, "Delay (sec)"=0, "Channel Model"="AWGN"}
outputs:
  "Eye Diagram": cluster{"t0": f64, "dt": f64, "Y": f64[]}[]
  "Average Bit-Error Rate": f64
  "I Data": waveform<f64>
  "Q Data": waveform<f64>
  "Signal Constellation": cluster{"Element 1": f64[], "Element 2": f64[]}[]
  "Measured Channel Impairements": T2
  "error out": error
  "Offset": i32
  "Power Delay Profile": waveform<f64>
panel controls:
  "Tab": i32
  "Parameters": i32
panel indicators:
  "Packet Detected": bool
  "Bit-Error Rate": f64
  "Coerced Bandwidth": f64
  "Coerced Carrier Frequency (Hz)": f64
  "Coerced Gain (dB)": f64
  "Key Bit Sequence": u8[]
  "Symbol Rate": f64
  "Overhead Offset": i32
types:
  T1 = cluster{"Active Antenna": string, "Carrier Frequency (Hz)": f64, "Gain (dB)": f64, "Trigger Level": f64, "Bandwidth (Hz)": f64, "Reference Position (%)": f64, "Capture Time (s)": f64, "Simulate": bool, "Device IP Address": string}
  T2 = cluster{"SNR(dB)": f64, "channel estimate": c128[], "freq. offset": f64, "delay": f64}
  T3 = cluster{"Noise Power (dB)": f64, "Channel Response": c128[], "Frequency Offset": f64, "Delay (sec)": f64, "Channel Model": string}
  T4 = cluster{"Training Sequence (derived)": c128[], "Zero Pad Length": i32}
  T5 = cluster{"Synchronization Method": string, "Fixed Offset": i32, "Symbol Timing Recovery Method": string, "Frame Detection Method": string, "Frequency Estimation Method": string, "Correct Frequency Offset": bool, "Correct Symbol Timing": bool}
  T6 = enum{"none", "Raised Cosine", "Root Raised Cos", "Gaussian"}
  T7 = cluster{"Modulation Type": enum{"FSK", "PSK", "QAM", "MSK", "PAM", "ASK"}, "Pulse Shaping Filter": T6, "Filter Parameter": f64, "Filter Length (Symbols)": i32}
  T8 = cluster{"Equalization Method": string, "Channel Estimate Length": i32, "Equalizer Length": i32, "Equalizer Delay": i32, "Equalize": bool}
  T9 = cluster{"Modulation Type": string, "Control Information\nfor Packet Header/Tail": T4, "RX Oversample Factor": i32, "Synchronization Options": T5, "Number of Data Symbols (Derived)": i32, "RX Sample Rate": f64, "Pulse Shaping Parameters": T7, "Channel Estimation/Equalization Parameters": T8}
diagram:
  case ($"error in") {
    frame No Error {
      sequence {
        frame 0 {
          $"Packet Detected" <- FALSE
          # Initialize RF Hardware
          call "RXRF_init.gvi"(HW Parameters In=$"HW Parameters", Modulation Parameters In=$"Modulation Parameters", error in (no error)=$"error in") -> (error out=w2, HW Parameters Out=w3, Modulation Parameters Out=w4, Queues out=w5, USRP Session out=w6)
        }
        frame 1 {
          while (iteration -> i1) {
            $"Packet Detected" <- FALSE
            # Configure RF for acquisition
            # simulate?
            call "RXRF_config.gvi"(HW Parameters In=w3, USRP Session In=w6, Queues in=w5, Modulation Parameters In=w4, error in (no error)=w2) -> (HW Parameters Out=w8, Modulation Parameters Out=w9, Simulate=w10, Queues out=w11, error out=w12, USRP Session Out=w13, Coerced Carrier Frequency (Hz)=w14, Coerced Bandwidth=w15, Coerced Gain (dB)=w16)
            case (w10) {
              frame False, Default {
                call "RXRF_recv.gvi"(USRP Session In=w13, HW Parameters In=w8, Modulation Parameters In=w9, error in (no error)=w12, Queues in=w11) -> (Packet Detected=w19, USRP Session Out=w18, HW Parameters Out=w20, Modulation Parameters Out=w21, error out=w22, Received IQ waveform=w24, Queues out=w23)
                Property Node(instance in=w21) -> ("RX Sample Rate"=w25)
                call "MT Resample (Complex Cluster).gvi"(input complex waveform=w24, desired sample rate=w25) -> (output complex waveform=w17)
              }
              frame True {
                Property Node(instance in=w9) -> ("RX Sample Rate"=w26)
                call "MT Resample (Complex Cluster).gvi"(input complex waveform=$"Received IQ Waveform", desired sample rate=w26) -> (output complex waveform=w17)
                w18 = w13
                w19 = w10
                w20 = w8
                w21 = w9
                w22 = w12
                w23 = w11
              }
            }
            # Acquire if trigger level exceeded
            case (w19) {
              frame False, Default {
                w27 = w22
                w28 = w18
                w29 = default
                w30 = w23
                w31 = w20
              }
              frame True {
                $"Packet Detected" <- TRUE
                call "reveciver_plot_IQ (SubVI).gvi"(Received IQ waveform=w17, error in=w22) -> (Q=w32, I=w33, error out=w34)
                # Plot I and Q phases of received signal
                $"Q Data" <- w32
                $"I Data" <- w33
                call "receiver.gvi"(HW Parameters In=w20, Modulation Parameters In=w21, Queues In=w23, error in (no error)=w34, Input Complex Waveform=w17, TX Channel Model Parameters=$"TX Channel Model Parameters") -> (error out=w27, HW Parameters Out=w31, Queues Out=w30, RX waveforms out=w35, Overhead Offset=w36, Symbol Rate=w37, Bit-Error Rate=w29, Offset=w38, Key Bit Sequence=w39, Measured channel impairements=w40)
                $"Overhead Offset" <- w36
                $"Symbol Rate" <- w37
                Property Node(instance in=w35) -> ("IQ Graph"=w41, "Eye Diagram"=w42, "Power Delay Profile"=w43)
                $"Signal Constellation" <- w41
                $"Eye Diagram" <- w42
                $"Power Delay Profile" <- w43
                $Offset <- w38
                $"Key Bit Sequence" <- w39
                $"Measured Channel Impairements" <- w40
                w28 = w18
              }
            }
            $"Bit-Error Rate" <- w29
            $"Coerced Gain (dB)" <- w16
            $"error out" <- w27
            $"Coerced Bandwidth" <- w15
            $"Coerced Carrier Frequency (Hz)" <- w14
            Increment(x=i1) -> w44
            Is Equal(x=$"# of Receive Iterations", y=w44) -> w45
            Property Node(instance in=w27) -> ("status"=w46)
            Logical Or(w46, $Stop, w45) -> w47
            append w29 to w7
            stop if w47
          }
          call "Mean (DBL).gvi"(X=w7) -> (mean=w48)
          $"Average Bit-Error Rate" <- w48
        }
        frame 2 {
          # Close USRP session
          call "RXRF_close (SubVI).gvi"(HW Parameters In=w31, error in=w27, Queues In=w30, USRP Session=w28) -> (error out=w1)
          $"Packet Detected" <- FALSE
        }
      }
    }
    frame Error {
      w1 = $"error in"
    }
  }
  $"error out" <- w1
