vi "RXRF_config.gvi"   [LabVIEW NXG]
inputs:
  "HW Parameters In": T2 = {"Active Antenna"="RX1", "Carrier Frequency (Hz)"=915000000, "Gain (dB)"=10, "Trigger Level"=0.01, "Bandwidth (Hz)"=915000000, "Reference Position (%)"=10, "Capture Time (s)"=0.0033, "Simulate"=FALSE, "Device IP Address"="192.168.10.2"}
  "USRP Session In": niUSRP
  "Queues in": T1
  "Modulation Parameters In": T8 = {"Modulation Type"="QPSK", "Control Information\nfor Packet Header/Tail"={"Training Sequence (derived)"=[], "Zero Pad Length"=0}, "RX Oversample Factor"=20, "Synchronization Options"={"Synchronization Method"="Timing Estimation", "Fixed Offset"=0, "Symbol Timing Recovery Method"="Max Energy", "Frame Detection Method"="Sliding Correlator", "Frequency Estimation Method"="", "Correct Frequency Offset"=FALSE, "Correct Symbol Timing"=FALSE}, "Number of Data Symbols (Derived)"=100, "RX Sample Rate"=4000000, "Pulse Shaping Parameters"={"Modulation Type"="PSK", "Pulse Shaping Filter"="Root Raised Cos", "Filter Parameter"=0.5, "Filter Length (Symbols)"=8}, "Channel Estimation/Equalization Parameters"={"Equalization Method"="Direct", "Channel Estimate Length"=1, "Equalizer Length"=1, "Equalizer Delay"=-1, "Equalize"=FALSE}}
  "error in (no error)": error
outputs:
  "HW Parameters Out": T2
  "Modulation Parameters Out": T8
  "Simulate": bool
  "Queues out": T1
  "error out": error
  "USRP Session Out": niUSRP
  "Coerced Carrier Frequency (Hz)": f64
  "Coerced Bandwidth": f64
  "Coerced Gain (dB)": f64
types:
  T1 = cluster{"Element 1": Queue<u8[]>, "Element 2": Queue<c128[]>}
  T2 = cluster{"Active Antenna": string, "Carrier Frequency (Hz)": f64, "Gain (dB)": f64, "Trigger Level": f64, "Bandwidth (Hz)": f64, "Reference Position (%)": f64, "Capture Time (s)": f64, "Simulate": bool, "Device IP Address": string}
  T3 = cluster{"Training Sequence (derived)": c128[], "Zero Pad Length": i32}
  T4 = cluster{"Synchronization Method": string, "Fixed Offset": i32, "Symbol Timing Recovery Method": string, "Frame Detection Method": string, "Frequency Estimation Method": string, "Correct Frequency Offset": bool, "Correct Symbol Timing": bool}
  T5 = enum{"none", "Raised Cosine", "Root Raised Cos", "Gaussian"}
  T6 = cluster{"Modulation Type": enum{"FSK", "PSK", "QAM", "MSK", "PAM", "ASK"}, "Pulse Shaping Filter": T5, "Filter Parameter": f64, "Filter Length (Symbols)": i32}
  T7 = cluster{"Equalization Method": string, "Channel Estimate Length": i32, "Equalizer Length": i32, "Equalizer Delay": i32, "Equalize": bool}
  T8 = cluster{"Modulation Type": string, "Control Information\nfor Packet Header/Tail": T3, "RX Oversample Factor": i32, "Synchronization Options": T4, "Number of Data Symbols (Derived)": i32, "RX Sample Rate": f64, "Pulse Shaping Parameters": T6, "Channel Estimation/Equalization Parameters": T7}
diagram:
  $"Queues out" <- $"Queues in"
  $"Modulation Parameters Out" <- $"Modulation Parameters In"
  $"HW Parameters Out" <- $"HW Parameters In"
  case ($"error in (no error)") {
    frame No Error {
      Property Node(instance in=$"HW Parameters In") -> ("Simulate"=w2)
      case (w2) {
        frame False, Default {
          Property Node(instance in=$"Modulation Parameters In") -> ("RX Sample Rate"=w3)
          Property Node(instance in=$"HW Parameters In") -> ("Carrier Frequency (Hz)"=w4, "Gain (dB)"=w5, "Active Antenna"=w6, "Bandwidth (Hz)"=w7)
          call "niUSRP Configure Signal.gvi"(session handle=$"USRP Session In", IQ rate=w3, carrier frequency=w4, gain=w5, error in (no error)=$"error in (no error)", active antenna=w6) -> (session handle out=w8, coerced carrier frequency=w9, coerced gain=w10, Error Out=w11)
          $"Coerced Carrier Frequency (Hz)" <- w9
          $"Coerced Gain (dB)" <- w10
          Property Node(instance in=w8, error in=w11, "Configuration:Bandwidth"=w7) -> (instance out=w12, error out=w1, "Configuration:Bandwidth"=w13)
          $"USRP Session Out" <- w12
          $"Coerced Bandwidth" <- w13
        }
        frame True {
          w1 = $"error in (no error)"
        }
      }
      $Simulate <- w2
    }
    frame Error {
      w1 = $"error in (no error)"
    }
  }
  $"error out" <- w1
