vi "RXRF_recv.gvi"   [LabVIEW NXG]
inputs:
  "USRP Session In": niUSRP
  "HW Parameters In": T2 = {"Active Antenna"="RX1", "Carrier Frequency (Hz)"=915000000, "Gain (dB)"=10, "Trigger Level"=0.01, "Bandwidth (Hz)"=915000000, "Reference Position (%)"=10, "Capture Time (s)"=0.0033, "Simulate"=FALSE, "Device IP Address"="192.168.10.2"}
  "Modulation Parameters In": T8 = {"Modulation Type"="QPSK", "Control Information\nfor Packet Header/Tail"={"Training Sequence (derived)"=[], "Zero Pad Length"=0}, "RX Oversample Factor"=20, "Synchronization Options"={"Synchronization Method"="Timing Estimation", "Fixed Offset"=0, "Symbol Timing Recovery Method"="Max Energy", "Frame Detection Method"="Sliding Correlator", "Frequency Estimation Method"="", "Correct Frequency Offset"=FALSE, "Correct Symbol Timing"=FALSE}, "Number of Data Symbols (Derived)"=100, "RX Sample Rate"=4000000, "Pulse Shaping Parameters"={"Modulation Type"="PSK", "Pulse Shaping Filter"="Root Raised Cos", "Filter Parameter"=0.5, "Filter Length (Symbols)"=8}, "Channel Estimation/Equalization Parameters"={"Equalization Method"="Direct", "Channel Estimate Length"=1, "Equalizer Length"=1, "Equalizer Delay"=-1, "Equalize"=FALSE}}
  "error in (no error)": error
  "Queues in": T1
outputs:
  "Packet Detected": bool
  "USRP Session Out": niUSRP
  "HW Parameters Out": T2
  "Modulation Parameters Out": T8
  "error out": error
  "Received IQ waveform": cluster{"t0": f64, "dt": f64, "Y": c128[]}
  "Queues out": T1
types:
  T1 = cluster{"Element 1": Queue<u8[]>, "Element 2": Queue<c128[]>}
  T2 = cluster{"Active Antenna": string, "Carrier Frequency (Hz)": f64, "Gain (dB)": f64, "Trigger Level": f64, "Bandwidth (Hz)": f64, "Reference Position (%)": f64, "Capture Time (s)": f64, "Simulate": bool, "Device IP Address": string}
  T3 = cluster{"Training Sequence (derived)": c128[], "Zero Pad Length": i32}
  T4 = cluster{"Synchronization Method": string, "Fixed Offset": i32, "Symbol Timing Recovery Method": string, "Frame Detection Method": string, "Frequency Estimation Method": string, "Correct Frequency Offset": bool, "Correct Symbol Timing": bool}
  T5 = enum{"none", "Raised Cosine", "Root Raised Cos", "Gaussian"}
  T6 = cluster{"Modulation Type": enum{"FSK", "PSK", "QAM", "MSK", "PAM", "ASK"}, "Pulse Shaping Filter": T5, "Filter Parameter": f64, "Filter Length (Symbols)": i32}
  T7 = cluster{"Equalization Method": string, "Channel Estimate Length": i32, "Equalizer Length": i32, "Equalizer Delay": i32, "Equalize": bool}
  T8 = cluster{"Modulation Type": string, "Control Information\nfor Packet Header/Tail": T3, "RX Oversample Factor": i32, "Synchronization Options": T4, "Number of Data Symbols (Derived)": i32, "RX Sample Rate": f64, "Pulse Shaping Parameters": T6, "Channel Estimation/Equalization Parameters": T7}
diagram:
  $"Queues out" <- $"Queues in"
  $"Modulation Parameters Out" <- $"Modulation Parameters In"
  $"HW Parameters Out" <- $"HW Parameters In"
  case ($"error in (no error)") {
    frame No Error {
      Property Node(instance in=$"HW Parameters In") -> ("Capture Time (s)"=w2, "Trigger Level"=w3, "Reference Position (%)"=w4)
      call "niUSRP Initiate.gvi"(session handle=$"USRP Session In", error in (no error)=$"error in (no error)") -> (session handle out=w5, Error Out=w6)
      # Initiate capture
      Property Node(instance in=$"Modulation Parameters In") -> ("RX Sample Rate"=w7)
      Multiply(w7, w2) -> w8
      Round To Nearest(number=w8) -> w9
      call "RXRF_trigger_and_capture.gvi"(USRP Session In=w5, trigger level=w3, Reference Position=w4, error in (no error)=w6, number of samples=w9) -> (USRP Session out=w10, IQ Waveform=w11, packet found=w12, error out=w13)
      $"Received IQ waveform" <- w11
      # stop capture so that
      # other processing can occur
      call "niUSRP Abort.gvi"(Handle in=w10, error in (no error)=w13) -> (Handle out=w14, Error Out=w1)
      $"USRP Session Out" <- w14
      Property Node(instance in=w1) -> ("code"=w15)
      # packet detected if no error occurs and
      # the receiver did not timeout
      Is Equal To 0(x=w15) -> w16
      Logical And(w16, w12) -> w17
      $"Packet Detected" <- w17
    }
    frame Error {
      w1 = $"error in (no error)"
    }
  }
  $"error out" <- w1
