vi "RXRF_trigger_and_capture.gvi"   [LabVIEW NXG]
inputs:
  "USRP Session In": niUSRP
  "trigger level": f64
  "Reference Position": f64
  "error in (no error)": error
  "number of samples": i64 = -1
outputs:
  "USRP Session out": niUSRP
  "IQ Waveform": cluster{"t0": f64, "dt": f64, "Y": c128[]}
  "packet found": bool
  "error out": error
diagram:
  case ($"error in (no error)") {
    frame No Error {
      Multiply($"Reference Position", 0.01) -> w2
      Multiply(w2, $"number of samples") -> w3
      Round To Nearest(number=w3) -> w4
      # NOTE: The value 40
      # represents the approx. size
      #  of the initial RX transient
      #  in samples.
      call "niUSRP Fetch Rx Data (CDB Cluster).gvi"(session handle=$"USRP Session In", number of samples=40, error in (no error)=$"error in (no error)") -> (session handle out=w5, Error Out=w6)
      # Collect enough data to fill the
      # prefetch portion plus enough
      # to skip the RX transient
      call "niUSRP Fetch Rx Data (CDB Cluster).gvi"(session handle=w5, number of samples=$"number of samples", error in (no error)=w6) -> (session handle out=w7, data=w8, Error Out=w9)
      Tick Count() -> (millisecond timer value=w10)
      # Check to see if the magnitude of the received data
      # surpasses the threshold
      # # of pre-trigger samples
      # current data
      # previous data
      # first index is
      # the trigger point
      s1 = w8  # shift register
      while {
        call "niUSRP Fetch Rx Data (CDB Cluster).gvi"(session handle=w7, number of samples=$"number of samples", error in (no error)=w9) -> (session handle out=w12, data=w13, Error Out=w14)
        Property Node(instance in=w13) -> ("Y"=w15)
        Complex To Polar(r * e^(i*theta)=w15) -> (r=w16)
        call "Threshold Detector.gvi"(x=w16, threshold=$"trigger level") -> (indices=w17, count=w18)
        Is Greater Than 0(x=w18) -> w19
        $"packet found" <- w19
        Property Node(instance in=w14) -> ("status"=w20)
        Add(w10, 100) -> w21
        Tick Count() -> (millisecond timer value=w22)
        Is Greater(x=w22, y=w21) -> w23
        Logical Or(w20, w19, w23) -> w24
        w11 = s1
        next s1 = w13
        stop if w24
      }
      Array Index(array=w17) -> (out0[0]=w25)
      Add(w25, 1) -> w26
      Subtract(x=w26, y=w4) -> w27
      Is Greater Than 0(x=w27) -> w28
      # check if we need data from the previous fetch
      # or data from the next fetch to complete the
      # number of samples requested
      # # of samples to get from new fetch
      # trigger level
      # number of samples
      case (w28) {
        frame False, Default {
          Property Node(instance in=s1) -> ("Y"=w31)
          # need to get data from previous
          # fetch
          Property Node(instance in=w11) -> ("Y"=w32)
          Build Array[ConcatenateInputs=True](w32, w31) -> w33
          Complex To Polar(r * e^(i*theta)=w33) -> (r=w34)
          call "Threshold Detector.gvi"(x=w34, threshold=$"trigger level") -> (indices=w35)
          # first index is
          # the trigger point
          Array Index(array=w35) -> (out0[0]=w36)
          Subtract(x=w36, y=w4) -> w37
          Array Subset(array=w33, index0=w37, length0=$"number of samples") -> w38
          Property Node(instance in=s1, "Y"=w38) -> (instance out=w30)
          w29 = w12
          w1 = w14
        }
        frame True {
          call "niUSRP Fetch Rx Data (CDB Cluster).gvi"(session handle=w12, number of samples=w27, error in (no error)=w14) -> (session handle out=w29, data=w39, Error Out=w1)
          Property Node(instance in=w39) -> ("Y"=w40)
          # need to fetch next set of data
          Property Node(instance in=s1) -> ("Y"=w41)
          Build Array[ConcatenateInputs=True](w41, w40) -> w42
          Array Subset(array=w42, index0=w27, length0=$"number of samples") -> w43
          Property Node(instance in=s1, "Y"=w43) -> (instance out=w30)
        }
      }
      $"IQ Waveform" <- w30
      $"USRP Session out" <- w29
    }
    frame Error {
      w1 = $"error in (no error)"
    }
  }
  $"error out" <- w1
