vi "TXRF_send.gvi"   [LabVIEW NXG]
inputs:
  "USRP Session in": niUSRP
  "error in": error
  "IQ Data in": cluster{"t0": f64, "dt": f64, "Y": c128[]} = {"t0"=0, "dt"=1, "Y"=[]}
  "end of data?": bool
  "HW Parameters In": T1 = {"Active Antenna"="TX1", "Carrier Frequency (Hz)"=915000000, "Gain (dB)"=10, "Generation Mode"="Single Shot", "Device IP Address"="192.168.10.3"}
outputs:
  "HW Parameters Out": T1
  "error out": error
  "USRP Session out": niUSRP
types:
  T1 = cluster{"Active Antenna": string, "Carrier Frequency (Hz)": f64, "Gain (dB)": f64, "Generation Mode": enum{"Single Shot", "Simulate", "Continuous"}, "Device IP Address": string}
diagram:
  $"HW Parameters Out" <- $"HW Parameters In"
  case ($"error in") {
    frame No Error {
      call "niUSRP Write Tx Data (CDB Cluster).gvi"(session handle=$"USRP Session in", data=$"IQ Data in", end of data?=$"end of data?", error in (no error)=$"error in") -> (session handle out=w2, Error Out=w1)
      $"USRP Session out" <- w2
    }
    frame Error {
      call "niUSRP Close Session.gvi"(Handle in=$"USRP Session in", error in (no error)=$"error in") -> (Error Out=w1)
    }
  }
  $"error out" <- w1
