vi "A3.gvi"   [LabVIEW NXG]
inputs:
  "y": waveform<f64> = {dt=0.1, Y=[]}
outputs:
  "modulé": waveform<f64>
diagram:
  w1 = 20000000  # fc
  w2 = FALSE  # suppress carrier?
  w3 = 0.7  # ka
  call "MT Modulate FM.gvi"(message signal=$y, fm deviation=w3, reset?=w2) -> (fm modulated waveform=w4)
  call "MT Upconvert Baseband (Real).gvi"(baseband waveform=w4, carrier frequency=w1) -> (passband waveform=w5)
  $modulé <- w5
