vi "Function.gvi"   [LabVIEW NXG]
panel indicators:
  "Graph": f64[]
  "Modulant": waveform<f64>
  "abs(FFT)": cluster{"y": f64, "f0": f64, "d0": f64[]}
  "démodulé (downconverted)": cluster{"t0": f64, "dt": f64, "Y": c128[]}
  "démodulé": waveform<f64>
  "Modulant-Démodulé": cluster{"Element 1": f64[], "Element 2": f64[]}
  "Modulé - Fréquence": cluster{"y": f64, "f0": f64, "d0": f64[]}
  "Démodulé - Fréquence": cluster{"y": f64, "f0": f64, "d0": f64[]}
  "Modulé": waveform<f64>
  "Modullé - Fréquence -DB": cluster{"y": f64, "f0": f64, "d0": f64[]}
diagram:
  w1 = 20000000  # fs
  w2 = 0.002  # T
  Multiply(w2, w1) -> w3
  Round To Nearest(number=w3) -> w4
  To Long Integer(number=w4) -> w5
  for (N = w5) (iteration -> i1) {
    Reciprocal(x=w1) -> w7
    To Double Precision Float(number=i1) -> w8
    Multiply(w7, w8) -> w9
    append w9 to w6
  }
  $Graph <- w6
  Reciprocal(x=w1) -> w10
  w11 = 2  # c
  w12 = 1  # Am
  w13 = 5000  # fm
  Multiply(w6, PiTimes2, w13) -> w14
  Cosine(x=w14) -> w15
  Multiply(w12, w15) -> w16
  Add(w11, w16) -> w17
  Build Waveform Node(Y=w17, dt=w10) -> (output waveform=w18)
  $Modulant <- w18
  call "A3.gvi"(y=w18, kf=25000) -> (modulé=w19)
  $Modulé <- w19
  call "Démodulateur_Cohérent.gvi"(y=w19) -> (démodulé=w20, démodulé (downconverted)=w21)
  call "XY.gvi"(X=w18, Y=w20) -> (created cluster=w22)
  $"Modulant-Démodulé" <- w22
  call "FFT.gvi"(T=w2, y=w19) -> (FFT=w23)
  $"Modulé - Fréquence" <- w23
  call "FFT.gvi"(T=w2, y=w18) -> (FFT=w24)
  $"abs(FFT)" <- w24
  call "FFT.gvi"(T=w2, y=w20) -> (FFT=w25)
  $"Démodulé - Fréquence" <- w25
  $démodulé <- w20
  $"démodulé (downconverted)" <- w21
  Logarithm Base 10(x=w23) -> w26
  Multiply(w26, 20) -> w27
  $"Modullé - Fréquence -DB" <- w27
