vi "XY.gvi"   [LabVIEW NXG]
inputs:
  "X": waveform<f64> = {dt=0.1, Y=[]}
  "Y": waveform<f64> = {dt=0.1, Y=[]}
outputs:
  "created cluster": cluster{"Element 1": f64[], "Element 2": f64[]}
diagram:
  Property Node(instance in=$X) -> ("Y"=w1)
  Property Node(instance in=$Y) -> ("Y"=w2)
  Build Cluster(w1, w2) -> w3
  $"created cluster" <- w3
