vi "Main Demodulate.gvi"   [LabVIEW NXG]
panel controls:
  "Stop": bool
  "device name": string = "192.168.10.2"
  "active antenna": string = "RX1"
  "IQ rate": f64 = 200000
  "carrier frequency": f64 = 95700000
  "gain": f64
  "number of samples": i64 = 10000
  "averaging mode": T2 = "No averaging"
panel indicators:
  "coerced gain": f64
  "coerced frequency": f64
  "coerced IQ rate": f64
  "IQ Plot": f64[]
  "Frequency Plot": T1
  "Error Out": error
types:
  T1 = cluster{"f0": f64, "df": f64, "magnitude": f64[]}
  T2 = enum{"No averaging", "Vector averaging", "RMS averaging", "Peak hold"}
  T3 = cluster{"averaging mode": T2, "weighting mode": enum{"Linear", "Exponential"}, "number of averages": u32}
diagram:
  call "niUSRP Open Rx Session.gvi"(Device names=$"device name") -> (Error Out=w1, Session handle=w2)
  call "niUSRP Configure Signal.gvi"(session handle=w2, IQ rate=$"IQ rate", carrier frequency=$"carrier frequency", gain=$gain, error in (no error)=w1, active antenna=$"active antenna") -> (session handle out=w3, coerced IQ rate=w4, coerced carrier frequency=w5, coerced gain=w6, Error Out=w7)
  call "niUSRP Initiate.gvi"(session handle=w3, error in (no error)=w7) -> (session handle out=w8, Error Out=w9)
  call "Simple Sound.gvi"(Action="Open") -> (sample rate (S/s)=w10, Error=w11, task ID=w12)
  Reciprocal(x=w4) -> w13
  while {
    w14 = cluster{"t0": timestamp, "dt": f64, "Y": c128[]} {all zero or empty}
    Property Node(instance in=w14, "dt"=w13) -> (instance out=w15, "Y"=w16)  # Cluster Properties
    Complex To Real Imaginary(x + iy=w16) -> (x=w17, y=w18)  # Complex to Real and Imaginary
    Build Array(w17, w18) -> w19
    $"IQ Plot" <- w19
    w20 = T3 {"averaging mode"="No averaging", "weighting mode"="Exponential", "number of averages"=10}
    Property Node(instance in=w20, "averaging mode"=$"averaging mode") -> (instance out=w21)
    call "FFT Power Spectrum for 1 Chan (CDB).gvi"(time signal=w15, dB On (F)=TRUE, averaging parameters=w21) -> (power spectrum=w22)
    $"Frequency Plot" <- w22
    # COMPLETE HERE
    call "niUSRP Fetch Rx Data (CDB Cluster).gvi"(session handle=w8, number of samples=$"number of samples", error in (no error)=w9) -> (session handle out=w23, Error Out=w24)
    call "Simple Resample.gvi"(input=w16, coerced IQ rate=w4, sample rate (S/s)=w10) -> (output=w25)
    Build Waveform Node(Y=w25, dt=w13) -> (output waveform=w26)
    call "Simple Sound.gvi"(device ID=w12, error in (no error)=w11, Action="Write", data=w26) -> (Error=w27, task ID=w28)
    Logical Or(w24, w27, $Stop) -> w29
    stop if w29
  }
  call "Simple Sound.gvi"(device ID=w28, error in (no error)=w27, Action="Close") -> (Error=w30)
  Merge Errors(w24, w30) -> (error out=w31)
  call "niUSRP Abort.gvi"(Handle in=w23, error in (no error)=w31) -> (Handle out=w32, Error Out=w33)
  call "niUSRP Close Session.gvi"(Handle in=w32, error in (no error)=w33) -> (Error Out=w34)
  $"Error Out" <- w34
  $"coerced IQ rate" <- w4
  $"coerced frequency" <- w5
  $"coerced gain" <- w6
